# Grasshopper definition netreader_2.gh (Grasshopper 1.0.7)
# plug-ins: Sandbox Topology, Kangaroo2 Components

path = FilePath("C:\Users\rb1619\Documents\GitHub\scientific-data-visualization\Assets\Resources\Prefabs\3D\dolphins_network\dolphins_edgs.csv")
path_2 = FilePath("C:\Users\rb1619\Documents\GitHub\scientific-data-visualization\Assets\Resources\Prefabs\3D\dolphins_network\dolphines_nodes_3d.csv")
file = ReadFile(File=path_2, PerLineParse=True)
file_2 = ReadFile(File=path, PerLineParse=True)
split = TextSplit(Text=file, Separators=",")
split_2 = TextSplit(Text=file_2, Separators=",")
item = ListItem(List=split, Index=1, Wrap=True)
item_2 = ListItem(List=split, Index=2, Wrap=True)  # -> flatten(Item)
item_3 = ListItem(List=split, Index=3, Wrap=True)  # -> flatten(Item)
item_4 = ListItem(List=split, Index=4, Wrap=True)  # -> flatten(Item)
item_5 = ListItem(List=split_2, Index=0, Wrap=True)  # -> flatten(Item)
item_6 = ListItem(List=split_2, Index=1, Wrap=True)  # -> flatten(Item)
item_7 = ListItem(List=split_2, Index=2, Wrap=True)  # -> flatten(Item)
join = TextJoin(Text=item, Join=" ")  # -> flatten(Result)
int = Integer(item_2)
int_2 = Integer(item_3)
int_3 = Integer(item_4)
int_4 = Integer(item_5)
int_5 = Integer(item_6)
int_6 = Integer(item_7)
pt = ConstructPoint(XCoordinate=int, YCoordinate=int_2, ZCoordinate=int_3)
item_8 = ListItem(List=pt, Index=int_5, Wrap=True)
item_9 = ListItem(List=pt, Index=int_4, Wrap=True)
ln = Line(StartPoint=item_9, EndPoint=item_8)
line_topo = LineTopology(ListOfLines=ln, Tolerance=0.001)  # -> ListOfPoints, LinePointStructure, PointPointStructure, PointLineStructure
fsim = FindSimilarMember(Data=pt, Set=line_topo.ListOfPoints)  # -> Hit, Index
fsim_2 = FindSimilarMember(Data=line_topo.ListOfPoints, Set=pt)  # -> Hit, Index
item_10 = ListItem(List=join, Index=fsim_2.Index, Wrap=True)
item_11 = ListItem(List=fsim.Index, Index=int_4, Wrap=True)
item_12 = ListItem(List=fsim.Index, Index=int_5, Wrap=True)
item_13 = ListItem(List=fsim.Index, Index=int_6, Wrap=True)
item_14 = ListItem(List=pt, Index=fsim_2.Index, Wrap=True)
data = Data(line_topo.PointPointStructure)
txt = Text(item_10)
int_7 = Integer(item_11)
num = Number(item_13)
int_8 = Integer(item_12)
pt_2 = Point(item_14)
item_15 = ListItem(List=pt_2, Index=int_7, Wrap=True)
item_16 = ListItem(List=pt_2, Index=int_8, Wrap=True)
ln_2 = Line(StartPoint=item_15, EndPoint=item_16)

panel = Panel(item_10)

viewer = ParamViewer(line_topo.PointPointStructure)
lng = ListLength(List=viewer)
series = Series(Start=0, Step=1, Count=lng)  # -> simplify(graft(Series))
merge = Merge(Data1=line_topo.PointPointStructure, Data2=series)
int_9 = Integer(merge)
int_10 = Integer(int_9)
join_2 = TextJoin(Text=int_9, Join=",")
item_17 = ListItem(List=flatten(join_2), Index=int_10, Wrap=True)
split_3 = TextSplit(Text=item_17, Separators=",")
path_mapper = PathMapper(split_3, source="{A;B}", target="{A}")
int_11 = Integer(path_mapper)
cset = CreateSet(List=int_11)  # -> Set, Map
lng_2 = ListLength(List=cset.Set)  # -> flatten(Length)
sort = SortList(Keys=lng_2, ValuesA=panel)  # -> Keys, ValuesA
panel_2 = Panel(sort.ValuesA)

panel_3 = Panel(sort.Keys)

pt_3 = Point(pt_2)
pdecon = Deconstruct(Point=pt_3)  # -> XComponent, YComponent, ZComponent
bnd = Bounds(Numbers=pdecon.XComponent)
bnd_2 = Bounds(Numbers=pdecon.YComponent)
bnd_3 = Bounds(Numbers=pdecon.ZComponent)
dedomain = DeconstructDomain(Domain=bnd)  # -> Start, End
dedomain_2 = DeconstructDomain(Domain=bnd_2)  # -> Start, End
dedomain_3 = DeconstructDomain(Domain=bnd_3)  # -> Start, End
avr = Average(Input=[dedomain.End, dedomain.Start])
avr_2 = Average(Input=[dedomain_3.End, dedomain_3.Start])
avr_3 = Average(Input=[dedomain_2.End, dedomain_2.Start])
pt_4 = ConstructPoint(XCoordinate=avr, YCoordinate=avr_3, ZCoordinate=dedomain_3.Start)
pt_5 = ConstructPoint(XCoordinate=avr, YCoordinate=avr_3, ZCoordinate=dedomain_3.End)
pt_6 = ConstructPoint(XCoordinate=avr, YCoordinate=dedomain_2.Start, ZCoordinate=avr_2)
pt_7 = ConstructPoint(XCoordinate=avr, YCoordinate=dedomain_2.End, ZCoordinate=avr_2)
pt_8 = ConstructPoint(XCoordinate=dedomain.Start, YCoordinate=avr_3, ZCoordinate=avr_2)
pt_9 = ConstructPoint(XCoordinate=dedomain.End, YCoordinate=avr_3, ZCoordinate=avr_2)
int_12 = Integer(100)
ln_3 = Line(StartPoint=pt_4, EndPoint=pt_5)
ln_4 = Line(StartPoint=pt_6, EndPoint=pt_7)
ln_5 = Line(StartPoint=pt_8, EndPoint=pt_9)
pframes = PerpFrames(Curve=ln_3, Count=int_12, Align=True)  # -> graft(Frames), Parameters
pframes_2 = PerpFrames(Curve=ln_4, Count=int_12, Align=True)  # -> graft(Frames), Parameters
pframes_3 = PerpFrames(Curve=ln_5, Count=int_12, Align=True)  # -> graft(Frames), Parameters
num_2 = Number(0.0009)
metaball_t = MetaBallT(Points=pt_3, Plane=pframes.Frames, Threshold=num_2, Accuracy=10)  # -> simplify(Isocurve)
metaball_t_2 = MetaBallT(Points=pt_3, Plane=pframes_2.Frames, Threshold=num_2, Accuracy=10)  # -> simplify(Isocurve)
metaball_t_3 = MetaBallT(Points=pt_3, Plane=pframes_3.Frames, Threshold=num_2, Accuracy=10)  # -> simplify(Isocurve)
int_13 = Integer(20)
topoly = CurveToPolyline(Curve=metaball_t, ToleranceDistance=2, ToleranceAngle=0)  # -> Polyline, Segments
topoly_2 = CurveToPolyline(Curve=metaball_t_2, ToleranceDistance=2, ToleranceAngle=0)  # -> Polyline, Segments
topoly_3 = CurveToPolyline(Curve=metaball_t_3, ToleranceDistance=10, ToleranceAngle=0)  # -> Polyline, Segments
cp = ControlPoints(Curve=topoly.Polyline)  # -> flatten(Points), Weights, Knots
cp_2 = ControlPoints(Curve=topoly_2.Polyline)  # -> flatten(Points), Weights, Knots
cp_3 = ControlPoints(Curve=topoly_3.Polyline)  # -> flatten(Points), Weights, Knots
duppt = RemoveDuplicatePts(Points=cp.Points, Tolerance=int_13)
duppt_2 = RemoveDuplicatePts(Points=cp_2.Points, Tolerance=int_13)
duppt_3 = RemoveDuplicatePts(Points=cp_3.Points, Tolerance=int_13)
merge_2 = Merge(Data1=duppt, Data2=duppt_2, Data3=duppt_3)  # -> flatten(Result)

pt_10 = Point(pt_2)

line = Line(ln_2)
int_14 = Integer(num)
bnd_4 = Bounds(Numbers=int_14)
dom = ConstructDomain(DomainStart=1, DomainEnd=10)
dom_2 = ConstructDomain(DomainStart=0, DomainEnd=3)
remap = RemapNumbers(Value=int_14, Source=bnd_4, Target=dom)  # -> Mapped, Clipped
remap_2 = RemapNumbers(Value=int_14, Source=bnd_4, Target=dom_2)  # -> Mapped, Clipped
int_15 = Integer(remap_2.Mapped)
custom_mesh_settings = SettingsCustom(
    StitchSeams=True,
    SimplePlanes=False,
    Refine=True,
    MinCount=4,
    MaxCount=400,
    AspectRatio=20000,
    MaxDistance=0,
    MaxAngle=200,
    MinEdge=8,
    MaxEdge=0)
pipe = Pipe(Curve=line, Radius=remap.Mapped, Caps=0)  # -> flatten(Pipe)
equals = Equality(FirstNumber=int_15, SecondNumber=0)  # -> Equality, Inequality
equals_2 = Equality(FirstNumber=int_15, SecondNumber=1)  # -> Equality, Inequality
equals_3 = Equality(FirstNumber=int_15, SecondNumber=2)  # -> Equality, Inequality
equals_4 = Equality(FirstNumber=int_15, SecondNumber=3)  # -> Equality, Inequality
mesh = MeshBrep(Brep=pipe, Settings=custom_mesh_settings)
dispatch = Dispatch(List=mesh, DispatchPattern=equals.Equality)  # -> ListA, ListB
dispatch_2 = Dispatch(List=mesh, DispatchPattern=equals_4.Equality)  # -> ListA, ListB
dispatch_3 = Dispatch(List=mesh, DispatchPattern=equals_3.Equality)  # -> ListA, ListB
dispatch_4 = Dispatch(List=mesh, DispatchPattern=equals_2.Equality)  # -> ListA, ListB
preview = CustomPreview(
    Geometry=[dispatch_3.ListA, dispatch_2.ListA],
    Material={diffuse=RGB(51, 51, 51), emission=RGB(0, 0, 0), shine=0, specular=RGB(255, 255, 255), transparency=0})
preview_2 = CustomPreview(
    Geometry=dispatch_4.ListA,
    Material={diffuse=RGB(105, 105, 105), emission=RGB(0, 0, 0), shine=0, specular=RGB(255, 255, 255), transparency=0})
preview_3 = CustomPreview(
    Geometry=dispatch.ListA,
    Material={diffuse=RGB(45, 45, 45), emission=RGB(0, 0, 0), shine=0, specular=RGB(255, 255, 255), transparency=0})
preview_4 = CustomPreview(
    Geometry=mesh,
    Material={diffuse=RGB(45, 45, 45), emission=RGB(0, 0, 0), shine=0, specular=RGB(255, 255, 255), transparency=0})

cp_4 = ClosestPoint(Point=pt_10, Cloud=merge_2)  # -> ClosestPoint, CPIndex, Distance
ln_6 = Line(StartPoint=pt_10, EndPoint=cp_4.ClosestPoint)
pt_11 = Point(graft(pt_10))
vec2pt = Vector2Pt(PointA=pt_10, PointB=cp_4.ClosestPoint, Unitize=False)  # -> Vector, Length

pt_12 = Point(pt_2)
data_2 = Data(data)
lng_3 = ListLength(List=data_2)  # -> flatten(Length)
bnd_5 = Bounds(Numbers=flatten(lng_3))
remap_3 = RemapNumbers(Value=lng_3, Source=bnd_5, Target=Domain(20, 40))  # -> Mapped, Clipped
remap_4 = RemapNumbers(Value=lng_3, Source=bnd_5, Target=Domain(20, 80))  # -> Mapped, Clipped
remap_5 = RemapNumbers(Value=lng_3, Source=bnd_5, Target=Domain(3, 6))  # -> Mapped, Clipped
remap_6 = RemapNumbers(Value=lng_3, Source=bnd_5, Target=Domain(0, 4))  # -> Mapped, Clipped
int_16 = Integer(remap_6.Mapped)
int_17 = Integer(remap_5.Clipped)
shader = Shader({diffuse=RGB(255, 0, 0), emission=RGB(0, 0, 0), shine=0, specular=RGB(255, 255, 255), transparency=0})
shader_2 = Shader({diffuse=RGB(255, 165, 0), emission=RGB(0, 0, 0), shine=0, specular=RGB(255, 255, 255), transparency=0})
shader_3 = Shader({diffuse=RGB(255, 245, 0), emission=RGB(0, 0, 0), shine=0, specular=RGB(255, 255, 255), transparency=0})
shader_4 = Shader({diffuse=RGB(137, 137, 137), emission=RGB(0, 0, 0), shine=0, specular=RGB(255, 255, 255), transparency=0})

remap_7 = RemapNumbers(Value=lng_3, Source=bnd_5, Target=Domain(0.1, 0.6))  # -> Mapped, Clipped
remap_8 = RemapNumbers(Value=lng_3, Source=bnd_5, Target=Domain(100, 300))  # -> Mapped, Clipped
multiplication = Multiplication(A=vec2pt.Length, B=remap_7.Clipped)

txt_2 = Text(txt)
pt_13 = Point(pt_2)
X = UnitX(Factor=1)
Z = UnitZ(Factor=1)
X_2 = UnitX(Factor=1)
pl = PlaneNormal(Origin=pt_13, ZAxis=X)
pl_2 = ConstructPlane(Origin=pl, XAxis=X_2, YAxis=Z)
c_script = CSharpScript(plane=pl_2, text=txt_2)  # -> out, simplify(curve), simplify(normal); inputs plane: Plane, text: String
# ---------- c_script: C# ----------
    var text_entity = new TextEntity
      {
        Plane = plane,
        RichText = text,
        Justification = TextJustification.MiddleCenter,
        FontIndex = doc.Fonts.FindOrCreate("Arial", false, false)
        };


    curve = text_entity.Explode();

    normal = plane.ZAxis;
# ---------- end c_script ----------
custom_mesh_settings_2 = SettingsCustom(
    StitchSeams=True,
    SimplePlanes=False,
    Refine=True,
    MinCount=2,
    MaxCount=200,
    AspectRatio=20000,
    MaxDistance=0,
    MaxAngle=20000,
    MinEdge=10,
    MaxEdge=0)
boundary = BoundarySurfaces(Edges=c_script.curve)
mesh_2 = MeshBrep(Brep=boundary, Settings=custom_mesh_settings_2)
mjoin = MeshJoin(Meshes=mesh_2)
unim = UnifyMesh(Mesh=mjoin)  # -> Result, Count
scale = Scale(Geometry=unim.Result, Center=graft(pl_2), Factor=graft(remap_4.Clipped))  # -> Geometry, Transform
bbox = BoundingBox(Content=scale.Geometry, Plane=graft(pl_2))  # -> Box, Box_2
rotate = Rotate(Geometry=scale.Geometry, Angle=3.141592654, Plane=graft(pl_2))  # -> Geometry, Transform
debox = DeconstructBox(Box=simplify(bbox.Box))  # -> Plane, X, Y, Z
dedomain_4 = DeconstructDomain(Domain=debox.Y)  # -> Start, End
abs = Absolute(Value=dedomain_4.Start)
avr_4 = Average(Input=[abs, dedomain_4.End])
Z_2 = UnitZ(Factor=avr_4)

addition = Addition(A=remap_8.Clipped, B=multiplication)
amp = Amplitude(Vector=vec2pt.Vector, Amplitude=addition)
msphereex = MeshSphereEx(Base=pt_12, Radius=remap_3.Mapped, Count=int_17)
move = Move(Geometry=pt_10, Motion=amp)  # -> Geometry, Transform

lng_4 = ListLength(List=msphereex)
lng_5 = ListLength(List=msphereex)
lng_6 = ListLength(List=msphereex)
lng_7 = ListLength(List=msphereex)
repeat = RepeatData(Data=shader, Length=lng_4)
repeat_2 = RepeatData(Data=shader_4, Length=lng_5)
repeat_3 = RepeatData(Data=shader_3, Length=lng_6)
repeat_4 = RepeatData(Data=shader_2, Length=lng_7)
p_n_c = PickNChoose(Pattern=int_16, Stream0=repeat_2, Stream1=repeat_3, Stream2=repeat_4, Stream3=repeat_4, Stream4=repeat)
preview_5 = CustomPreview(Geometry=msphereex, Material=p_n_c)

pt_14 = Point(move.Geometry)
pt_15 = Point(pt_11)
num_3 = Number(800)
number_slider = Slider(1.03, range=1..1.1)
cluster = Cluster(F=number_slider, pt=pt_15, in=pt_14, B=num_3)  # -> P, V, in_3
vdis = VectorDisplay(Anchor=cluster.in_3, Vector=cluster.V)
cluster_2 = Cluster(F=number_slider, pt=pt_15, in=cluster.P, B=num_3)  # -> P, V, in_3
vdis_2 = VectorDisplay(Anchor=cluster_2.in_3, Vector=cluster_2.V)
cluster_3 = Cluster(F=number_slider, pt=pt_15, in=cluster_2.P, B=num_3)  # -> P, V, in_3
vdis_3 = VectorDisplay(Anchor=cluster_3.in_3, Vector=cluster_3.V)
cluster_4 = Cluster(F=number_slider, pt=pt_15, in=cluster_3.P, B=num_3)  # -> P, V, in_3
vdis_4 = VectorDisplay(Anchor=cluster_4.in_3, Vector=cluster_4.V)
cluster_5 = Cluster(F=number_slider, pt=pt_15, in=cluster_4.P, B=num_3)  # -> P, V, in_3
vdis_5 = VectorDisplay(Anchor=cluster_5.in_3, Vector=cluster_5.V)
cluster_6 = Cluster(F=number_slider, pt=pt_15, in=cluster_5.P, B=num_3)  # -> P, V, in_3
vdis_6 = VectorDisplay(Anchor=cluster_6.in_3, Vector=cluster_6.V)
cluster_7 = Cluster(F=number_slider, pt=pt_15, in=cluster_6.P, B=num_3)  # -> P, V, in_3
vdis_7 = VectorDisplay(Anchor=cluster_7.in_3, Vector=cluster_7.V)
cluster_8 = Cluster(F=number_slider, pt=pt_15, in=cluster_7.P, B=num_3)  # -> P, V, in_3
vdis_8 = VectorDisplay(Anchor=cluster_8.in_3, Vector=cluster_8.V)
cluster_9 = Cluster(F=number_slider, pt=pt_15, in=cluster_8.P, B=num_3)  # -> P, V, in_3
vdis_9 = VectorDisplay(Anchor=cluster_9.in_3, Vector=cluster_9.V)
cluster_10 = Cluster(F=number_slider, pt=pt_15, in=cluster_9.P, B=num_3)  # -> P, V, in_3
vdis_10 = VectorDisplay(Anchor=cluster_10.in_3, Vector=cluster_10.V)
cluster_11 = Cluster(F=number_slider, pt=pt_15, in=cluster_10.P, B=num_3)  # -> P, V, in_3
vdis_11 = VectorDisplay(Anchor=cluster_11.in_3, Vector=cluster_11.V)
cluster_12 = Cluster(F=number_slider, pt=pt_15, in=cluster_11.P, B=num_3)  # -> P, V, in_3
vdis_12 = VectorDisplay(Anchor=cluster_12.in_3, Vector=cluster_12.V)
cluster_13 = Cluster(F=number_slider, pt=pt_15, in=cluster_12.P, B=num_3)  # -> P, V, in_3
vdis_13 = VectorDisplay(Anchor=cluster_13.in_3, Vector=cluster_13.V)
cluster_14 = Cluster(F=number_slider, pt=pt_15, in=cluster_13.P, B=num_3)  # -> P, V, in_3
vdis_14 = VectorDisplay(Anchor=cluster_14.in_3, Vector=cluster_14.V)
cluster_15 = Cluster(F=number_slider, pt=pt_15, in=cluster_14.P, B=num_3)  # -> P, V, in_3
vdis_15 = VectorDisplay(Anchor=cluster_15.in_3, Vector=cluster_15.V)
cluster_16 = Cluster(F=number_slider, pt=pt_15, in=cluster_15.P, B=num_3)  # -> P, V, in_3
cluster_17 = Cluster(F=number_slider, pt=pt_15, in=cluster_16.P, B=num_3)  # -> P, V, in_3
vdis_16 = VectorDisplay(Anchor=cluster_17.in_3, Vector=cluster_17.V)
cluster_18 = Cluster(F=number_slider, pt=pt_15, in=cluster_17.P, B=num_3)  # -> P, V, in_3
vdis_17 = VectorDisplay(Anchor=cluster_18.in_3, Vector=cluster_18.V)
cluster_19 = Cluster(F=number_slider, pt=pt_15, in=cluster_18.P, B=num_3)  # -> P, V, in_3
vdis_18 = VectorDisplay(Anchor=cluster_19.in_3, Vector=cluster_19.V)
cluster_20 = Cluster(F=number_slider, pt=pt_15, in=cluster_19.P, B=num_3)  # -> P, V, in_3
vdis_19 = VectorDisplay(Anchor=cluster_20.in_3, Vector=cluster_20.V)
cluster_21 = Cluster(F=number_slider, pt=pt_15, in=cluster_20.P, B=num_3)  # -> P, V, in_3
vdis_20 = VectorDisplay(Anchor=cluster_21.in_3, Vector=cluster_21.V)
cluster_22 = Cluster(F=number_slider, pt=pt_15, in=cluster_21.P, B=num_3)  # -> P, V, in_3
vdis_21 = VectorDisplay(Anchor=cluster_22.in_3, Vector=cluster_22.V)
cluster_23 = Cluster(F=number_slider, pt=pt_15, in=cluster_22.P, B=num_3)  # -> P, V, in_3
vdis_22 = VectorDisplay(Anchor=cluster_23.in_3, Vector=cluster_23.V)
cluster_24 = Cluster(F=number_slider, pt=pt_15, in=cluster_23.P, B=num_3)  # -> P, V, in_3
vdis_23 = VectorDisplay(Anchor=cluster_24.in_3, Vector=cluster_24.V)
cluster_25 = Cluster(F=number_slider, pt=pt_15, in=cluster_24.P, B=num_3)  # -> P, V, in_3
vdis_24 = VectorDisplay(Anchor=cluster_25.in_3, Vector=cluster_25.V)
cluster_26 = Cluster(F=number_slider, pt=pt_15, in=cluster_25.P, B=num_3)  # -> P, V, in_3
vdis_25 = VectorDisplay(Anchor=cluster_26.in_3, Vector=cluster_26.V)
cluster_27 = Cluster(F=number_slider, pt=pt_15, in=cluster_26.P, B=num_3)  # -> P, V, in_3
vdis_26 = VectorDisplay(Anchor=cluster_27.in_3, Vector=cluster_27.V)
cluster_28 = Cluster(F=number_slider, pt=pt_15, in=cluster_27.P, B=num_3)  # -> P, V, in_3
vdis_27 = VectorDisplay(Anchor=cluster_28.in_3, Vector=cluster_28.V)
cluster_29 = Cluster(F=number_slider, pt=pt_15, in=cluster_28.P, B=num_3)  # -> P, V, in_3
vdis_28 = VectorDisplay(Anchor=cluster_29.in_3, Vector=cluster_29.V)
cluster_30 = Cluster(F=number_slider, pt=pt_15, in=cluster_29.P, B=num_3)  # -> P, V, in_3
vdis_29 = VectorDisplay(Anchor=cluster_30.in_3, Vector=cluster_30.V)
cluster_31 = Cluster(F=number_slider, pt=pt_15, in=cluster_30.P, B=num_3)  # -> P, V, in_3
vdis_30 = VectorDisplay(Anchor=cluster_31.in_3, Vector=cluster_31.V)
cluster_32 = Cluster(F=number_slider, pt=pt_15, in=cluster_31.P, B=num_3)  # -> P, V, in_3
vdis_31 = VectorDisplay(Anchor=cluster_32.in_3, Vector=cluster_32.V)
vdis_32 = VectorDisplay(Anchor=cluster_16.in_3, Vector=cluster_16.V)

txt_3 = Text(txt_2)
vec = Vector(Z_2)
mesh_3 = Mesh(rotate.Geometry)
shader_5 = Shader(p_n_c)
pt_16 = Point(cluster_32.P)
pt_17 = Point(pt_11)
vec2pt_2 = Vector2Pt(PointA=pt_17, PointB=graft(pt_16), Unitize=False)  # -> Vector, Length
move_2 = Move(Geometry=mesh_3, Motion=vec2pt_2.Vector)  # -> Geometry, Transform
dprod = DotProduct(VectorA=vec, VectorB=vec2pt_2.Vector, Unitize=False)
abs_2 = Absolute(Value=dprod)
division = Division(A=dprod, B=abs_2)
multiplication_2 = Multiplication(A=vec, B=division)
move_3 = Move(Geometry=graft(pt_16), Motion=multiplication_2)  # -> Geometry, Transform
ln_7 = Line(StartPoint=move_3.Geometry, EndPoint=graft(pt_16))
ln_8 = Line(StartPoint=pt_17, EndPoint=graft(pt_16))
multiplication_3 = Multiplication(A=multiplication_2, B=2)
move_4 = Move(Geometry=move_2.Geometry, Motion=multiplication_3)  # -> Geometry, Transform
pipe_2 = Pipe(Curve=ln_8, Radius=1, Caps=0)
pipe_3 = Pipe(Curve=ln_7, Radius=1, Caps=0)
custom_mesh_settings_3 = SettingsCustom(
    StitchSeams=True,
    SimplePlanes=False,
    Refine=True,
    MinCount=4,
    MaxCount=400,
    AspectRatio=20000,
    MaxDistance=0,
    MaxAngle=200,
    MinEdge=8,
    MaxEdge=0)
mesh_4 = MeshBrep(Brep=pipe_3, Settings=custom_mesh_settings_3)
mesh_5 = MeshBrep(Brep=pipe_2, Settings=custom_mesh_settings_3)
preview_6 = CustomPreview(Geometry=flatten(move_4.Geometry), Material=shader_5)
preview_7 = CustomPreview(Geometry=flatten(mesh_4), Material=shader_5)
preview_8 = CustomPreview(Geometry=flatten(mesh_5), Material=shader_5)

txt_4 = Text(graft(txt_3))  # disabled
pt_18 = Point(move_3.Geometry)  # disabled
devec = DeconstructVector(Vector=pt_18)  # -> XComponent, YComponent, ZComponent; disabled
join_3 = TextJoin(Text=[txt_4, devec.XComponent, devec.YComponent, devec.ZComponent], Join=",")  # -> flatten(Result); disabled
panel_4 = Panel(join_3)  # disabled

# ==== cluster Cluster
pt = ClusterInput()
in = ClusterInput()
pt_2 = Point(simplify(flatten(pt)))
in_2 = Point(simplify(graft(in)))
in_3 = ClusterOutput(in_2)
pt_3 = Point(flatten([in_2, pt_2]))
panel = Panel(pt_2)
cps = ClosestPoints(Point=in_2, Cloud=pt_3, Count=5)  # -> ClosestPoint, CPIndex, Distance
split = SplitList(List=cps.ClosestPoint, Index=1)  # -> ListA, simplify(ListB)
dist = Distance(PointA=in_2, PointB=split.ListB)
B = ClusterInput()
dist_2 = Distance(PointA=pt_2, PointB=flatten(in_2))
smaller = SmallerThan(FirstNumber=dist, SecondNumber=B)  # -> simplify(SmallerThan), OrEqualTo
dispatch = Dispatch(List=split.ListB, DispatchPattern=smaller.SmallerThan)  # -> ListA, ListB
X = UnitX(Factor=1)
vec2pt = Vector2Pt(PointA=in_2, PointB=dispatch.ListA, Unitize=False)  # -> Vector, Length
lng = ListLength(List=vec2pt.Vector)
equals = Equality(FirstNumber=lng, SecondNumber=0)  # -> Equality, Inequality
p_n_c = PickNChoose(Pattern=equals.Equality, Stream1=X)
bnd = Bounds(Numbers=vec2pt.Length)
unit = UnitVector(Vector=vec2pt.Vector)
clean = CleanTree(RemoveNulls=True, RemoveInvalid=True, RemoveEmpty=False, Tree=p_n_c)
rev = Reverse(Vector=unit)
remap = RemapNumbers(Value=vec2pt.Length, Source=bnd, Target=Domain(100, 20))  # -> Mapped, Clipped
merge = Merge(Data1=clean, Data2=rev)
null = NullItem(Item=remap.Clipped)  # -> NullFlags, InvalidFlags, Description
p_n_c_2 = PickNChoose(Pattern=null.NullFlags, Stream0=remap.Clipped, Stream1=1e-07)
amp = Amplitude(Vector=merge, Amplitude=p_n_c_2)
avr = Average(Input=amp)
msphereex = MeshSphereEx(Base=pt_2, Radius=dist_2, Count=4)  # -> graft(Mesh)
F = ClusterInput()
move = Move(Geometry=in_2, Motion=avr)  # -> Geometry, Transform
scale = Scale(Geometry=flatten(msphereex), Center=pt_2, Factor=F)  # -> graft(Geometry), Transform
meshcp = MeshClosestPoint(Point=move.Geometry, Mesh=scale.Geometry)  # -> Point, Index, Parameter
P = ClusterOutput(meshcp.Point)
vec2pt_2 = Vector2Pt(PointA=in_2, PointB=meshcp.Point, Unitize=False)  # -> Vector, Length
V = ClusterOutput(vec2pt_2.Vector)
