# Grasshopper definition second degree analysiss.gh (Grasshopper 1.0.7)
# plug-ins: Sandbox Topology

path = FilePath("C:\Users\rb1619\Documents\GitHub\scientific-data-visualization\Assets\Resources\Prefabs\3D\network\edges.csv")
path_2 = FilePath("C:\Users\rb1619\Documents\GitHub\scientific-data-visualization\Assets\Resources\Prefabs\3D\new_network\atlas_nodes.csv")
file = ReadFile(File=path_2, PerLineParse=True)
file_2 = ReadFile(File=path, PerLineParse=True)
split = TextSplit(Text=file, Separators=",")
split_2 = SplitList(List=file_2, Index=Slider(2742, range=0..2742))  # -> ListA, ListB
split_3 = TextSplit(Text=split_2.ListA, Separators=",")
item = ListItem(List=split, Index=1, Wrap=True)
item_2 = ListItem(List=split, Index=3, Wrap=True)
item_3 = ListItem(List=split, Index=4, Wrap=True)  # -> flatten(Item)
item_4 = ListItem(List=split, Index=5, Wrap=True)  # -> flatten(Item)
item_5 = ListItem(List=split, Index=6, Wrap=True)  # -> flatten(Item)
item_6 = ListItem(List=split_3, Index=0, Wrap=True)  # -> flatten(Item)
item_7 = ListItem(List=split_3, Index=1, Wrap=True)  # -> flatten(Item)
item_8 = ListItem(List=split_3, Index=2, Wrap=True)  # -> flatten(Item)
join = TextJoin(Text=[item, item_2], Join=" ")  # -> flatten(Result)
int = Integer(item_3)
int_2 = Integer(item_4)
int_3 = Integer(item_5)
int_4 = Integer(item_6)
int_5 = Integer(item_7)
int_6 = Integer(item_8)
pt = ConstructPoint(XCoordinate=int, YCoordinate=int_2, ZCoordinate=int_3)
item_9 = ListItem(List=pt, Index=int_5, Wrap=True)
item_10 = ListItem(List=pt, Index=int_4, Wrap=True)
ln = Line(StartPoint=item_10, EndPoint=item_9)
line_topo = LineTopology(ListOfLines=ln, Tolerance=0.001)  # -> ListOfPoints, LinePointStructure, PointPointStructure, PointLineStructure
fsim = FindSimilarMember(Data=pt, Set=line_topo.ListOfPoints)  # -> Hit, Index
fsim_2 = FindSimilarMember(Data=line_topo.ListOfPoints, Set=pt)  # -> Hit, Index
item_11 = ListItem(List=join, Index=fsim_2.Index, Wrap=True)
item_12 = ListItem(List=fsim.Index, Index=int_4, Wrap=True)
item_13 = ListItem(List=fsim.Index, Index=int_5, Wrap=True)
item_14 = ListItem(List=fsim.Index, Index=int_6, Wrap=True)
item_15 = ListItem(List=pt, Index=fsim_2.Index, Wrap=True)
txt = Text(item_11)
int_7 = Integer(item_12)
num = Number(item_14)
int_8 = Integer(item_13)
pt_2 = Point(item_15)
item_16 = ListItem(List=pt_2, Index=int_7, Wrap=True)
item_17 = ListItem(List=pt_2, Index=int_8, Wrap=True)
ln_2 = Line(StartPoint=item_16, EndPoint=item_17)

viewer = ParamViewer(line_topo.PointPointStructure)
lng = ListLength(List=viewer)
series = Series(Start=0, Step=1, Count=lng)  # -> simplify(graft(Series))
merge = Merge(Data1=line_topo.PointPointStructure, Data2=series)
data = Data(line_topo.PointPointStructure)
int_9 = Integer(merge)
cluster = Cluster(pp=int_9, int=int_9)
cluster_2 = Cluster(pp=int_9, int=cluster)
cluster_3 = Cluster(pp=int_9, int=cluster_2)
cluster_4 = Cluster(pp=int_9, int=cluster_3)
cluster_5 = Cluster(pp=int_9, int=cluster_4)
cluster_6 = Cluster(pp=int_9, int=cluster_5)
cluster_7 = Cluster(pp=int_9, int=cluster_6)
cluster_8 = Cluster(pp=int_9, int=cluster_7)
cluster_9 = Cluster(pp=int_9, int=cluster_8)
cluster_10 = Cluster(pp=int_9, int=cluster_9)
cluster_11 = Cluster(pp=int_9, int=cluster_10)
cluster_12 = Cluster(pp=int_9, int=cluster_11)
cluster_13 = Cluster(pp=int_9, int=cluster_12)
cluster_14 = Cluster(pp=int_9, int=cluster_13)
cluster_15 = Cluster(pp=int_9, int=cluster_14)
cluster_16 = Cluster(pp=int_9, int=cluster_15)
join_2 = TextJoin(Text=cluster_16, Join=",")  # -> graft(Result)

# ==== cluster Cluster
int = ClusterInput()
pp = ClusterInput()
int_2 = Integer(int)
join = TextJoin(Text=pp, Join=",")
item = ListItem(List=flatten(join), Index=int_2, Wrap=True)
split = TextSplit(Text=item, Separators=",")
path_mapper = PathMapper(split, source="{A;B}", target="{A}")
int_3 = Integer(path_mapper)
cset = CreateSet(List=int_3)  # -> Set, Map
sort = SortList(Keys=cset.Set)  # -> Keys, ValuesA
join_2 = TextJoin(Text=sort.Keys, Join=",")  # -> flatten(Result)
cset_2 = CreateSet(List=join_2)  # -> graft(Set), Map
split_2 = TextSplit(Text=cset_2.Set, Separators=",")  # -> simplify(Result)
R = ClusterOutput(split_2)
