# Grasshopper definition fb0589d3-8996-831d-32d7-41d15560012c.gh (Grasshopper 1.0.7)
# plug-ins: Sandbox Topology

path = FilePath("C:\Users\rb1619\Desktop\network\atlas_nodes.csv")
path_2 = FilePath("C:\Users\rb1619\Desktop\network\edges.csv")
file = ReadFile(File=path, PerLineParse=True)
file_2 = ReadFile(File=path_2, PerLineParse=True)
split = TextSplit(Text=file, Separators=",")
split_2 = SplitList(List=file_2, Index=Slider(2742, range=0..2742))  # -> ListA, ListB
split_3 = TextSplit(Text=split_2.ListA, Separators=",")
item = ListItem(List=split, Index=1, Wrap=True)
item_2 = ListItem(List=split, Index=3, Wrap=True)
item_3 = ListItem(List=split, Index=4, Wrap=True)  # -> flatten(Item)
item_4 = ListItem(List=split, Index=5, Wrap=True)  # -> flatten(Item)
item_5 = ListItem(List=split, Index=6, Wrap=True)  # -> flatten(Item)
item_6 = ListItem(List=split_3, Index=0, Wrap=True)  # -> flatten(Item)
item_7 = ListItem(List=split_3, Index=1, Wrap=True)  # -> flatten(Item)
item_8 = ListItem(List=split_3, Index=2, Wrap=True)  # -> flatten(Item)
join = TextJoin(Text=[item, item_2], Join=" ")  # -> flatten(Result)
int = Integer(item_3)
int_2 = Integer(item_4)
int_3 = Integer(item_5)
int_4 = Integer(item_6)
int_5 = Integer(item_7)
int_6 = Integer(item_8)
cset = CreateSet(List=[int_4, int_5])  # -> Set, Map
bnd = Bounds(Numbers=int_6)
dom = ConstructDomain(DomainStart=5, DomainEnd=30)
pt = ConstructPoint(XCoordinate=int, YCoordinate=int_2, ZCoordinate=int_3)
X = UnitX(Factor=1)
dedomain = DeconstructDomain(Domain=dom)  # -> Start, End
remap = RemapNumbers(Value=int_6, Source=bnd, Target=dom)  # -> Mapped, Clipped
gradient = Gradient(
    LowerLimit=dedomain.Start,
    UpperLimit=dedomain.End,
    Parameter=remap.Mapped,
    stops=[0.0744: RGB(92, 0, 0), 0.728: RGB(255, 0, 0)])
pl = PlaneNormal(Origin=pt, ZAxis=X)
item_9 = ListItem(List=pt, Index=int_4, Wrap=True)
item_10 = ListItem(List=pt, Index=cset.Set, Wrap=True)
item_11 = ListItem(List=pt, Index=int_5, Wrap=True)
tag = TextTag3D(Location=pl, Text=join, Size=Slider(46.427, range=0..100), Justification=7)
ln = Line(StartPoint=item_9, EndPoint=item_11)
pipe = Pipe(Curve=ln, Radius=remap.Mapped, Caps=0)  # -> flatten(Pipe)
line_topo = LineTopology(ListOfLines=ln, Tolerance=0.001)  # -> ListOfPoints, LinePointStructure, PointPointStructure, PointLineStructure
preview = CustomPreview(Geometry=pipe, Material=gradient)
lng = ListLength(List=line_topo.PointPointStructure)  # -> flatten(Length)
bnd_2 = Bounds(Numbers=flatten(lng))
number_slider = Slider(7, range=3..10)
remap_2 = RemapNumbers(Value=lng, Source=bnd_2, Target=Domain(20, 100))  # -> Mapped, Clipped
dedomain_2 = DeconstructDomain(Domain=bnd_2)  # -> Start, End
gradient_2 = Gradient(
    LowerLimit=dedomain_2.Start,
    UpperLimit=dedomain_2.End,
    Parameter=lng,
    stops=[0.0438: RGB(255, 255, 255), 0.371: RGB(238, 255, 0), 0.805: RGB(220, 0, 40)])
msphere = MeshSphere(Base=line_topo.ListOfPoints, Radius=remap_2.Mapped, UCount=number_slider, VCount=number_slider)
preview_2 = CustomPreview(Geometry=msphere, Material=gradient_2)
