# Grasshopper definition netreader.gh (Grasshopper 1.0.7)
# plug-ins: Sandbox Topology, Kangaroo2 Components

path = FilePath("C:\Users\rb1619\Documents\GitHub\scientific-data-visualization\Assets\Resources\Prefabs\3D\network\edges.csv")
path_2 = FilePath("C:\Users\rb1619\Documents\GitHub\scientific-data-visualization\Assets\Resources\Prefabs\3D\new_network\atlas_nodes.csv")
file = ReadFile(File=path_2, PerLineParse=True)
file_2 = ReadFile(File=path, PerLineParse=True)
split = TextSplit(Text=file, Separators=",")
split_2 = SplitList(List=file_2, Index=Slider(2742, range=0..2742))  # -> ListA, ListB
split_3 = TextSplit(Text=split_2.ListA, Separators=",")
item = ListItem(List=split, Index=1, Wrap=True)
item_2 = ListItem(List=split, Index=3, Wrap=True)
item_3 = ListItem(List=split, Index=4, Wrap=True)  # -> flatten(Item)
item_4 = ListItem(List=split, Index=5, Wrap=True)  # -> flatten(Item)
item_5 = ListItem(List=split, Index=6, Wrap=True)  # -> flatten(Item)
item_6 = ListItem(List=split_3, Index=0, Wrap=True)  # -> flatten(Item)
item_7 = ListItem(List=split_3, Index=1, Wrap=True)  # -> flatten(Item)
item_8 = ListItem(List=split_3, Index=2, Wrap=True)  # -> flatten(Item)
join = TextJoin(Text=[item, item_2], Join=" ")  # -> flatten(Result)
int = Integer(item_3)
int_2 = Integer(item_4)
int_3 = Integer(item_5)
int_4 = Integer(item_6)
int_5 = Integer(item_7)
int_6 = Integer(item_8)
cset = CreateSet(List=[int_4, int_5])  # -> Set, Map
number_slider = Slider(46.427, range=0..100)
pt = ConstructPoint(XCoordinate=int, YCoordinate=int_2, ZCoordinate=int_3)
X = UnitX(Factor=1)
Z = UnitZ(Factor=1)
X_2 = UnitX(Factor=1)
pl = PlaneNormal(Origin=pt, ZAxis=X)
item_9 = ListItem(List=pt, Index=int_4, Wrap=True)
item_10 = ListItem(List=pt, Index=cset.Set, Wrap=True)
item_11 = ListItem(List=pt, Index=int_5, Wrap=True)
pl_2 = ConstructPlane(Origin=pl, XAxis=X_2, YAxis=Z)
ln = Line(StartPoint=item_9, EndPoint=item_11)
line_topo = LineTopology(ListOfLines=ln, Tolerance=0.001)  # -> ListOfPoints, LinePointStructure, PointPointStructure, PointLineStructure
fsim = FindSimilarMember(Data=line_topo.ListOfPoints, Set=pt)  # -> Hit, Index
item_12 = ListItem(List=pl_2, Index=fsim.Index, Wrap=True)
item_13 = ListItem(List=join, Index=fsim.Index, Wrap=True)
c_script = CSharpScript(plane=item_12, text=item_13)  # -> out, simplify(curve), simplify(normal); inputs plane: Plane, text: String
# ---------- c_script: C# ----------
    var text_entity = new TextEntity
      {
        Plane = plane,
        RichText = text,
        Justification = TextJustification.MiddleCenter,
        FontIndex = doc.Fonts.FindOrCreate("Arial", false, false)
        };


    curve = text_entity.Explode();

    normal = plane.ZAxis;
# ---------- end c_script ----------
bnd = Bounds(Numbers=int_6)
dom = ConstructDomain(DomainStart=5, DomainEnd=30)
dom_2 = ConstructDomain(DomainStart=0, DomainEnd=3)
lng = ListLength(List=line_topo.PointPointStructure)  # -> flatten(Length)
remap = RemapNumbers(Value=int_6, Source=bnd, Target=dom)  # -> Mapped, Clipped
remap_2 = RemapNumbers(Value=int_6, Source=bnd, Target=dom_2)  # -> Mapped, Clipped
custom_mesh_settings = SettingsCustom(
    StitchSeams=True,
    SimplePlanes=False,
    Refine=True,
    MinCount=2,
    MaxCount=200,
    AspectRatio=20000,
    MaxDistance=0,
    MaxAngle=20000,
    MinEdge=10,
    MaxEdge=0)
bnd_2 = Bounds(Numbers=flatten(lng))
item_14 = ListItem(List=pt, Index=fsim.Index, Wrap=True)
boundary = BoundarySurfaces(Edges=c_script.curve)
remap_3 = RemapNumbers(Value=lng, Source=bnd_2, Target=Domain(40, 80))  # -> Mapped, Clipped
remap_4 = RemapNumbers(Value=lng, Source=bnd_2, Target=Domain(35, 60))  # -> Mapped, Clipped
remap_5 = RemapNumbers(Value=lng, Source=bnd_2, Target=Domain(5, 8))  # -> Mapped, Clipped
remap_6 = RemapNumbers(Value=lng, Source=bnd_2, Target=Domain(0, 4))  # -> Mapped, Clipped
jagged = SettingsSpeed()
int_7 = Integer(remap_2.Mapped)
custom_mesh_settings_2 = SettingsCustom(
    StitchSeams=True,
    SimplePlanes=False,
    Refine=True,
    MinCount=4,
    MaxCount=400,
    AspectRatio=20000,
    MaxDistance=0,
    MaxAngle=200,
    MinEdge=8,
    MaxEdge=0)
pipe = Pipe(Curve=ln, Radius=remap.Mapped, Caps=0)  # -> flatten(Pipe)
prox = Proximity3D(Points=item_14, Group=20, MaxRadius=5000)  # -> simplify(Links), Topology
mesh = MeshBrep(Brep=boundary, Settings=custom_mesh_settings)
panel = Panel("""891
890
889""")
int_8 = Integer(remap_6.Mapped)
int_9 = Integer(remap_5.Clipped)
item_15 = ListItem(List=item_14, Index=Slider(891, range=0..1461), Wrap=True)
equals = Equality(FirstNumber=int_7, SecondNumber=0)  # -> Equality, Inequality
mjoin = MeshJoin(Meshes=mesh)
equals_2 = Equality(FirstNumber=int_7, SecondNumber=1)  # -> Equality, Inequality
equals_3 = Equality(FirstNumber=int_7, SecondNumber=2)  # -> Equality, Inequality
equals_4 = Equality(FirstNumber=int_7, SecondNumber=3)  # -> Equality, Inequality
mesh_2 = MeshBrep(Brep=pipe, Settings=custom_mesh_settings_2)
branch = TreeBranch(Tree=prox.Links, Path=panel, MaintainPaths=True)
unim = UnifyMesh(Mesh=mjoin)  # -> Result, Count
msphere = MeshSphere(Base=line_topo.ListOfPoints, Radius=remap_3.Mapped, UCount=int_9, VCount=int_9)
end = EndPoints(Curve=prox.Links)  # -> Start, End
lng_2 = ListLength(List=msphere)
branch_2 = TreeBranch(Tree=simplify(graft(item_14)), Path=panel, MaintainPaths=True)
lng_3 = ListLength(List=msphere)
lng_4 = ListLength(List=msphere)
lng_5 = ListLength(List=msphere)
scale = Scale(Geometry=unim.Result, Center=graft(item_12), Factor=graft(remap_4.Clipped))  # -> Geometry, Transform
cset_2 = CreateSet(List=[end.Start, end.End])  # -> Set, Map
dispatch = Dispatch(List=mesh_2, DispatchPattern=equals.Equality)  # -> ListA, ListB
dispatch_2 = Dispatch(List=mesh_2, DispatchPattern=equals_4.Equality)  # -> ListA, ListB
dispatch_3 = Dispatch(List=mesh_2, DispatchPattern=equals_3.Equality)  # -> ListA, ListB
dispatch_4 = Dispatch(List=mesh_2, DispatchPattern=equals_2.Equality)  # -> ListA, ListB
vec2pt = Vector2Pt(PointA=end.End, PointB=end.Start, Unitize=False)  # -> Vector, Length
shader = Shader({diffuse=RGB(255, 0, 0), emission=RGB(0, 0, 0), shine=0, specular=RGB(255, 255, 255), transparency=0})
shader_2 = Shader({diffuse=RGB(255, 165, 0), emission=RGB(0, 0, 0), shine=0, specular=RGB(255, 255, 255), transparency=0})
shader_3 = Shader({diffuse=RGB(255, 245, 0), emission=RGB(0, 0, 0), shine=0, specular=RGB(255, 255, 255), transparency=0})
shader_4 = Shader({diffuse=RGB(137, 137, 137), emission=RGB(0, 0, 0), shine=0, specular=RGB(255, 255, 255), transparency=0})
avr = Average(Input=cset_2.Set)
plfit = PlaneFit(Points=cset_2.Set)  # -> Plane, Deviation
bbox = BoundingBox(Content=scale.Geometry, Plane=graft(item_12))  # -> Box, Box_2
rotate = Rotate(Geometry=scale.Geometry, Angle=3.141592654, Plane=graft(item_12))  # -> Geometry, Transform
pt_2 = Point(graft(item_14))
preview = CustomPreview(
    Geometry=[dispatch_3.ListA, dispatch_2.ListA],
    Material={diffuse=RGB(51, 51, 51), emission=RGB(0, 0, 0), shine=0, specular=RGB(255, 255, 255), transparency=0})
preview_2 = CustomPreview(
    Geometry=dispatch_4.ListA,
    Material={diffuse=RGB(105, 105, 105), emission=RGB(0, 0, 0), shine=0, specular=RGB(255, 255, 255), transparency=0})
preview_3 = CustomPreview(
    Geometry=mesh_2,
    Material={diffuse=RGB(45, 45, 45), emission=RGB(0, 0, 0), shine=0, specular=RGB(255, 255, 255), transparency=0})
repeat = RepeatData(Data=shader, Length=lng_2)
repeat_2 = RepeatData(Data=shader_4, Length=lng_3)
repeat_3 = RepeatData(Data=shader_3, Length=lng_4)
repeat_4 = RepeatData(Data=shader_2, Length=lng_5)
preview_4 = CustomPreview(
    Geometry=dispatch.ListA,
    Material={diffuse=RGB(45, 45, 45), emission=RGB(0, 0, 0), shine=0, specular=RGB(255, 255, 255), transparency=0})
pl_origin = PlaneOrigin(Base=plfit.Plane, Origin=avr)
avr_2 = Average(Input=vec2pt.Vector)
debox = DeconstructBox(Box=simplify(bbox.Box))  # -> Plane, X, Y, Z
deplane = DeconstructPlane(Plane=pl_origin)  # -> Origin, XAxis, YAxis, ZAxis
dedomain = DeconstructDomain(Domain=debox.Y)  # -> Start, End
p_n_c = PickNChoose(Pattern=int_8, Stream0=repeat_2, Stream1=repeat_3, Stream2=repeat_4, Stream3=repeat_4, Stream4=repeat)
abs = Absolute(Value=dedomain.Start)
dprod = DotProduct(VectorA=deplane.ZAxis, VectorB=avr_2, Unitize=True)
avr_3 = Average(Input=[abs, dedomain.End])
lng_6 = ListLength(List=msphere)
lng_7 = ListLength(List=msphere)
lng_8 = ListLength(List=msphere)
lng_9 = ListLength(List=msphere)
abs_2 = Absolute(Value=dprod)
preview_5 = CustomPreview(Geometry=msphere, Material=p_n_c)
shader_5 = Shader({diffuse=RGB(255, 0, 0), emission=RGB(0, 0, 0), shine=0, specular=RGB(255, 255, 255), transparency=0})
shader_6 = Shader({diffuse=RGB(255, 165, 0), emission=RGB(0, 0, 0), shine=0, specular=RGB(255, 255, 255), transparency=0})
shader_7 = Shader({diffuse=RGB(255, 245, 0), emission=RGB(0, 0, 0), shine=0, specular=RGB(255, 255, 255), transparency=0})
shader_8 = Shader({diffuse=RGB(45, 45, 45), emission=RGB(0, 0, 0), shine=0, specular=RGB(255, 255, 255), transparency=0})
Z_2 = UnitZ(Factor=avr_3)
division = Division(A=abs_2, B=dprod)
repeat_5 = RepeatData(Data=shader_5, Length=lng_6)
repeat_6 = RepeatData(Data=shader_8, Length=lng_7)
repeat_7 = RepeatData(Data=shader_7, Length=lng_8)
repeat_8 = RepeatData(Data=shader_6, Length=lng_9)
multiplication = Multiplication(A=division, B=deplane.ZAxis)
move = Move(Geometry=pt_2, Motion=multiplication)  # -> Geometry, Transform
vec2pt_2 = Vector2Pt(PointA=pt_2, PointB=move.Geometry, Unitize=False)  # -> Vector, Length
p_n_c_2 = PickNChoose(Pattern=int_8, Stream0=repeat_6, Stream1=repeat_7, Stream2=repeat_8, Stream3=repeat_8, Stream4=repeat_5)
num = Number([vec2pt_2.Length, vec2pt.Vector])
vec = Vector([vec2pt_2.Vector, vec2pt.Vector])
bnd_3 = Bounds(Numbers=num)
unit = UnitVector(Vector=vec)
remap_7 = RemapNumbers(Value=num, Source=bnd_3, Target=Domain(1, 0.5))  # -> Mapped, Clipped
anchor = Anchor(Point=pt_2, Strength=Slider(0.002644, range=0..0.005))  # -> simplify(graft(A))
load = Load(Point=pt_2, ForceVector=unit, Weighting=remap_7.Mapped)  # -> simplify(graft(Unary))
solver = Solver(GoalObjects=[load, anchor], Reset=False, Threshold=1e-15, Tolerance=0.01, On=False)  # -> I, V, O
panel_2 = Panel(load)
crv = Curve(solver.O)
vec2pt_3 = Vector2Pt(PointA=pt_2, PointB=graft(solver.V), Unitize=False)  # -> Vector, Length
move_2 = Move(Geometry=rotate.Geometry, Motion=vec2pt_3.Vector)  # -> Geometry, Transform
dprod_2 = DotProduct(VectorA=Z_2, VectorB=vec2pt_3.Vector, Unitize=False)
abs_3 = Absolute(Value=dprod_2)
division_2 = Division(A=dprod_2, B=abs_3)
multiplication_2 = Multiplication(A=Z_2, B=division_2)
move_3 = Move(Geometry=graft(solver.V), Motion=multiplication_2)  # -> Geometry, Transform
ln_2 = Line(StartPoint=move_3.Geometry, EndPoint=graft(solver.V))
ln_3 = Line(StartPoint=pt_2, EndPoint=graft(solver.V))
multiplication_3 = Multiplication(A=multiplication_2, B=2)
move_4 = Move(Geometry=move_2.Geometry, Motion=multiplication_3)  # -> Geometry, Transform
pipe_2 = Pipe(Curve=ln_3, Radius=3, Caps=0)
pipe_3 = Pipe(Curve=ln_2, Radius=3, Caps=0)
custom_mesh_settings_3 = SettingsCustom(
    StitchSeams=True,
    SimplePlanes=False,
    Refine=True,
    MinCount=4,
    MaxCount=400,
    AspectRatio=20000,
    MaxDistance=0,
    MaxAngle=200,
    MinEdge=8,
    MaxEdge=0)
mesh_3 = MeshBrep(Brep=pipe_3, Settings=custom_mesh_settings_3)
mesh_4 = MeshBrep(Brep=pipe_2, Settings=custom_mesh_settings_3)
preview_6 = CustomPreview(Geometry=flatten(move_4.Geometry), Material=p_n_c_2)
preview_7 = CustomPreview(Geometry=flatten(mesh_3), Material=p_n_c)
preview_8 = CustomPreview(Geometry=flatten(mesh_4), Material=p_n_c)
txt = Text(graft(item_13))
pt_3 = Point(move_3.Geometry)
devec = DeconstructVector(Vector=pt_3)  # -> XComponent, YComponent, ZComponent
join_2 = TextJoin(Text=[txt, devec.XComponent, devec.YComponent, devec.ZComponent], Join=",")  # -> flatten(Result)
panel_3 = Panel(join_2)
