# Grasshopper definition remove_small_clusters.gh (Grasshopper 1.0.7)
# plug-ins: Sandbox Topology, Kangaroo2 Components

path = FilePath("C:\Users\rb1619\Documents\GitHub\scientific-data-visualization\Assets\Resources\Prefabs\3D\network\edges.csv")
path_2 = FilePath("C:\Users\rb1619\Documents\GitHub\scientific-data-visualization\Assets\Resources\Prefabs\3D\new_network\atlas_nodes.csv")
file = ReadFile(File=path_2, PerLineParse=True)
file_2 = ReadFile(File=path, PerLineParse=True)
split = TextSplit(Text=file, Separators=",")
split_2 = SplitList(List=file_2, Index=Slider(2742, range=0..2742))  # -> ListA, ListB
split_3 = TextSplit(Text=split_2.ListA, Separators=",")
item = ListItem(List=split, Index=1, Wrap=True)
item_2 = ListItem(List=split, Index=3, Wrap=True)
item_3 = ListItem(List=split, Index=4, Wrap=True)  # -> flatten(Item)
item_4 = ListItem(List=split, Index=5, Wrap=True)  # -> flatten(Item)
item_5 = ListItem(List=split, Index=6, Wrap=True)  # -> flatten(Item)
item_6 = ListItem(List=split_3, Index=0, Wrap=True)  # -> flatten(Item)
item_7 = ListItem(List=split_3, Index=1, Wrap=True)  # -> flatten(Item)
item_8 = ListItem(List=split_3, Index=2, Wrap=True)  # -> flatten(Item)
join = TextJoin(Text=[item, item_2], Join=" ")  # -> flatten(Result)
int = Integer(item_3)
int_2 = Integer(item_4)
int_3 = Integer(item_5)
int_4 = Integer(item_6)
int_5 = Integer(item_7)
int_6 = Integer(item_8)
pt = ConstructPoint(XCoordinate=int, YCoordinate=int_2, ZCoordinate=int_3)
item_9 = ListItem(List=pt, Index=int_5, Wrap=True)
item_10 = ListItem(List=pt, Index=int_4, Wrap=True)
ln = Line(StartPoint=item_10, EndPoint=item_9)
line_topo = LineTopology(ListOfLines=ln, Tolerance=0.001)  # -> ListOfPoints, LinePointStructure, PointPointStructure, PointLineStructure
fsim = FindSimilarMember(Data=pt, Set=line_topo.ListOfPoints)  # -> Hit, Index
fsim_2 = FindSimilarMember(Data=line_topo.ListOfPoints, Set=pt)  # -> Hit, Index
item_11 = ListItem(List=join, Index=fsim_2.Index, Wrap=True)
item_12 = ListItem(List=fsim.Index, Index=int_4, Wrap=True)
item_13 = ListItem(List=fsim.Index, Index=int_5, Wrap=True)
item_14 = ListItem(List=fsim.Index, Index=int_6, Wrap=True)
item_15 = ListItem(List=pt, Index=fsim_2.Index, Wrap=True)
txt = Text(item_11)
int_7 = Integer(item_12)
num = Number(item_14)
int_8 = Integer(item_13)
pt_2 = Point(item_15)
item_16 = ListItem(List=pt_2, Index=int_7, Wrap=True)
item_17 = ListItem(List=pt_2, Index=int_8, Wrap=True)
ln_2 = Line(StartPoint=item_16, EndPoint=item_17)

data = Data(line_topo.PointPointStructure)
number_slider = Slider(225.867, range=0..1000)  # disabled

viewer = ParamViewer(line_topo.PointPointStructure)
lng = ListLength(List=viewer)
series = Series(Start=0, Step=1, Count=lng)  # -> simplify(graft(Series))
merge = Merge(Data1=line_topo.PointPointStructure, Data2=series)
int_9 = Integer(merge)
cluster = Cluster(pp=int_9, int=int_9)
cluster_2 = Cluster(pp=int_9, int=cluster)
cluster_3 = Cluster(pp=int_9, int=cluster_2)
cluster_4 = Cluster(pp=int_9, int=cluster_3)
cluster_5 = Cluster(pp=int_9, int=cluster_4)
cluster_6 = Cluster(pp=int_9, int=cluster_5)
cluster_7 = Cluster(pp=int_9, int=cluster_6)
cluster_8 = Cluster(pp=int_9, int=cluster_7)
cluster_9 = Cluster(pp=int_9, int=cluster_8)
cluster_10 = Cluster(pp=int_9, int=cluster_9)
cluster_11 = Cluster(pp=int_9, int=cluster_10)
cluster_12 = Cluster(pp=int_9, int=cluster_11)
cluster_13 = Cluster(pp=int_9, int=cluster_12)
cluster_14 = Cluster(pp=int_9, int=cluster_13)
cluster_15 = Cluster(pp=int_9, int=cluster_14)
cluster_16 = Cluster(pp=int_9, int=cluster_15)
int_10 = Integer(cluster_16)
int_11 = Integer(int_7)
panel = Panel(cluster_16)
cset = CreateSet(List=cluster_16)  # -> Set, Map
mindex = MemberIndex(Set=int_11, Member=int_10)  # -> Index, Count
sort = SortList(Keys=cset.Set)  # -> Keys, ValuesA
join_2 = TextJoin(Text=cluster_16, Join=",")  # -> graft(Result)
path_mapper = PathMapper(mindex.Index, source="{A;B}", target="{A}")
join_3 = TextJoin(Text=cset.Set, Join=",")  # -> flatten(Result)
panel_2 = Panel(path_mapper)
cset_2 = CreateSet(List=join_3)  # -> Set, Map
split_4 = TextSplit(Text=cset_2.Set, Separators=",")  # -> simplify(Result)
int_12 = Integer(split_4)
lng_2 = ListLength(List=int_12)
smaller = SmallerThan(FirstNumber=lng_2, SecondNumber=6)  # -> flatten(SmallerThan), flatten(OrEqualTo)
dispatch = Dispatch(List=cset_2.Set, DispatchPattern=smaller.OrEqualTo)  # -> ListA, ListB
split_5 = TextSplit(Text=dispatch.ListA, Separators=",")  # -> simplify(flatten(Result))
split_6 = TextSplit(Text=dispatch.ListB, Separators=",")  # -> simplify(flatten(Result))
cset_3 = CreateSet(List=split_5)  # -> Set, Map
cset_4 = CreateSet(List=split_6)  # -> Set, Map
sort_2 = SortList(Keys=cset_3.Set)  # -> Keys, ValuesA
sort_3 = SortList(Keys=cset_4.Set)  # -> Keys, ValuesA
difference = SetDifference(SetA=sort_3.Keys, SetB=sort_2.Keys)
lng_3 = ListLength(List=cset_3.Set)
lng_4 = ListLength(List=difference)
addition = Addition(A=lng_3, B=lng_4)

pt_3 = Point(simplify(graft(line_topo.ListOfPoints)))
txt_2 = Text(txt)
int_13 = Integer(int_7)
num_2 = Number(num)
int_14 = Integer(int_8)
pt_4 = Point(pt_2)
data_2 = Data(data)
int_15 = Integer(difference)
int_16 = Integer(difference)
branch = TreeBranch(Tree=simplify(graft(txt_2)), Path=int_16, MaintainPaths=True)  # -> flatten(Branch)
branch_2 = TreeBranch(Tree=simplify(graft(pt_4)), Path=int_16, MaintainPaths=True)  # -> flatten(Branch)
intersection = SetIntersection(SetA=graft(int_13), SetB=int_15)
intersection_2 = SetIntersection(SetA=graft(int_14), SetB=int_15)
branch_3 = TreeBranch(Tree=pt_3, Path=int_16, MaintainPaths=True)  # -> flatten(Branch)
branch_4 = TreeBranch(Tree=data_2, Path=int_16, MaintainPaths=True)
lng_5 = ListLength(List=intersection)
lng_6 = ListLength(List=intersection_2)
multiplication = Multiplication(A=lng_5, B=lng_6)  # -> simplify(flatten(Result))
equals = Equality(FirstNumber=multiplication, SecondNumber=0)  # -> Equality, Inequality
dispatch_2 = Dispatch(List=int_13, DispatchPattern=equals.Equality)  # -> ListA, ListB
dispatch_3 = Dispatch(List=int_14, DispatchPattern=equals.Equality)  # -> ListA, ListB
dispatch_4 = Dispatch(List=num_2, DispatchPattern=equals.Equality)  # -> ListA, ListB
item_18 = ListItem(List=pt_4, Index=dispatch_2.ListB, Wrap=True)
item_19 = ListItem(List=pt_4, Index=dispatch_3.ListB, Wrap=True)
ln_3 = Line(StartPoint=item_18, EndPoint=item_19)

panel_3 = Panel(intersection_2)

pt_5 = Point(branch_2)
prox = Proximity3D(Points=pt_5, Group=20, MaxRadius=2000)  # -> simplify(Links), Topology
end = EndPoints(Curve=prox.Links)  # -> Start, End
cset_5 = CreateSet(List=[end.Start, end.End])  # -> Set, Map
vec2pt = Vector2Pt(PointA=end.End, PointB=end.Start, Unitize=False)  # -> Vector, Length
avr = Average(Input=cset_5.Set)
plfit = PlaneFit(Points=cset_5.Set)  # -> Plane, Deviation
pt_6 = Point(graft(pt_5))
pl_origin = PlaneOrigin(Base=plfit.Plane, Origin=avr)
avr_2 = Average(Input=vec2pt.Vector)
deplane = DeconstructPlane(Plane=pl_origin)  # -> Origin, XAxis, YAxis, ZAxis
dprod = DotProduct(VectorA=deplane.ZAxis, VectorB=avr_2, Unitize=True)
abs = Absolute(Value=dprod)
division = Division(A=abs, B=dprod)
multiplication_2 = Multiplication(A=division, B=deplane.ZAxis)
move = Move(Geometry=pt_6, Motion=multiplication_2)  # -> Geometry, Transform
vec2pt_2 = Vector2Pt(PointA=pt_6, PointB=move.Geometry, Unitize=False)  # -> Vector, Length
num_3 = Number([vec2pt_2.Length, vec2pt.Vector])
vec = Vector([vec2pt_2.Vector, vec2pt.Vector])
bnd = Bounds(Numbers=num_3)
unit = UnitVector(Vector=vec)
remap = RemapNumbers(Value=num_3, Source=bnd, Target=Domain(1, 0.2))  # -> Mapped, Clipped
anchor = Anchor(Point=pt_6, Strength=Slider(0.001339, range=0..0.005))  # -> simplify(graft(A))
load = Load(Point=pt_6, ForceVector=unit, Weighting=remap.Mapped)  # -> simplify(graft(Unary))
solver = Solver(GoalObjects=[load, anchor], Reset=Toggle(False), Threshold=1e-15, Tolerance=0.01, On=Toggle(False))  # -> I, V, O
panel_4 = Panel(load)

pt_7 = Point(branch_3)
data_3 = Data(branch_4)
lng_7 = ListLength(List=data_3)  # -> flatten(Length)
bnd_2 = Bounds(Numbers=flatten(lng_7))
remap_2 = RemapNumbers(Value=lng_7, Source=bnd_2, Target=Domain(40, 80))  # -> Mapped, Clipped
remap_3 = RemapNumbers(Value=lng_7, Source=bnd_2, Target=Domain(50, 80))  # -> Mapped, Clipped
remap_4 = RemapNumbers(Value=lng_7, Source=bnd_2, Target=Domain(5, 8))  # -> Mapped, Clipped
remap_5 = RemapNumbers(Value=lng_7, Source=bnd_2, Target=Domain(0, 4))  # -> Mapped, Clipped
int_17 = Integer(remap_5.Mapped)
int_18 = Integer(remap_4.Clipped)
msphere = MeshSphere(Base=pt_7, Radius=remap_2.Mapped, UCount=int_18, VCount=int_18)
lng_8 = ListLength(List=msphere)
lng_9 = ListLength(List=msphere)
lng_10 = ListLength(List=msphere)
lng_11 = ListLength(List=msphere)
shader = Shader({diffuse=RGB(255, 0, 0), emission=RGB(0, 0, 0), shine=0, specular=RGB(255, 255, 255), transparency=0})
shader_2 = Shader({diffuse=RGB(255, 165, 0), emission=RGB(0, 0, 0), shine=0, specular=RGB(255, 255, 255), transparency=0})
shader_3 = Shader({diffuse=RGB(255, 245, 0), emission=RGB(0, 0, 0), shine=0, specular=RGB(255, 255, 255), transparency=0})
shader_4 = Shader({diffuse=RGB(137, 137, 137), emission=RGB(0, 0, 0), shine=0, specular=RGB(255, 255, 255), transparency=0})
repeat = RepeatData(Data=shader, Length=lng_8)
repeat_2 = RepeatData(Data=shader_4, Length=lng_9)
repeat_3 = RepeatData(Data=shader_3, Length=lng_10)
repeat_4 = RepeatData(Data=shader_2, Length=lng_11)
p_n_c = PickNChoose(Pattern=int_17, Stream0=repeat_2, Stream1=repeat_3, Stream2=repeat_4, Stream3=repeat_4, Stream4=repeat)
preview = CustomPreview(Geometry=msphere, Material=p_n_c)

line = Line(ln_3)
int_19 = Integer(dispatch_4.ListB)
bnd_3 = Bounds(Numbers=int_19)
dom = ConstructDomain(DomainStart=5, DomainEnd=30)
dom_2 = ConstructDomain(DomainStart=0, DomainEnd=3)
remap_6 = RemapNumbers(Value=int_19, Source=bnd_3, Target=dom)  # -> Mapped, Clipped
remap_7 = RemapNumbers(Value=int_19, Source=bnd_3, Target=dom_2)  # -> Mapped, Clipped
int_20 = Integer(remap_7.Mapped)
custom_mesh_settings = SettingsCustom(
    StitchSeams=True,
    SimplePlanes=False,
    Refine=True,
    MinCount=4,
    MaxCount=400,
    AspectRatio=20000,
    MaxDistance=0,
    MaxAngle=200,
    MinEdge=8,
    MaxEdge=0)
pipe = Pipe(Curve=line, Radius=remap_6.Mapped, Caps=0)  # -> flatten(Pipe)
equals_2 = Equality(FirstNumber=int_20, SecondNumber=0)  # -> Equality, Inequality
equals_3 = Equality(FirstNumber=int_20, SecondNumber=1)  # -> Equality, Inequality
equals_4 = Equality(FirstNumber=int_20, SecondNumber=2)  # -> Equality, Inequality
equals_5 = Equality(FirstNumber=int_20, SecondNumber=3)  # -> Equality, Inequality
mesh = MeshBrep(Brep=pipe, Settings=custom_mesh_settings)
dispatch_5 = Dispatch(List=mesh, DispatchPattern=equals_2.Equality)  # -> ListA, ListB
dispatch_6 = Dispatch(List=mesh, DispatchPattern=equals_5.Equality)  # -> ListA, ListB
dispatch_7 = Dispatch(List=mesh, DispatchPattern=equals_4.Equality)  # -> ListA, ListB
dispatch_8 = Dispatch(List=mesh, DispatchPattern=equals_3.Equality)  # -> ListA, ListB
preview_2 = CustomPreview(
    Geometry=[dispatch_7.ListA, dispatch_6.ListA],
    Material={diffuse=RGB(51, 51, 51), emission=RGB(0, 0, 0), shine=0, specular=RGB(255, 255, 255), transparency=0})
preview_3 = CustomPreview(
    Geometry=dispatch_8.ListA,
    Material={diffuse=RGB(105, 105, 105), emission=RGB(0, 0, 0), shine=0, specular=RGB(255, 255, 255), transparency=0})
preview_4 = CustomPreview(
    Geometry=dispatch_5.ListA,
    Material={diffuse=RGB(45, 45, 45), emission=RGB(0, 0, 0), shine=0, specular=RGB(255, 255, 255), transparency=0})
preview_5 = CustomPreview(
    Geometry=mesh,
    Material={diffuse=RGB(45, 45, 45), emission=RGB(0, 0, 0), shine=0, specular=RGB(255, 255, 255), transparency=0})

txt_3 = Text(branch)
pt_8 = Point(branch_2)
X = UnitX(Factor=1)
Z = UnitZ(Factor=1)
X_2 = UnitX(Factor=1)
pl = PlaneNormal(Origin=pt_8, ZAxis=X)
pl_2 = ConstructPlane(Origin=pl, XAxis=X_2, YAxis=Z)
c_script = CSharpScript(plane=pl_2, text=txt_3)  # -> out, simplify(curve), simplify(normal); inputs plane: Plane, text: String
# ---------- c_script: C# ----------
    var text_entity = new TextEntity
      {
        Plane = plane,
        RichText = text,
        Justification = TextJustification.MiddleCenter,
        FontIndex = doc.Fonts.FindOrCreate("Arial", false, false)
        };


    curve = text_entity.Explode();

    normal = plane.ZAxis;
# ---------- end c_script ----------
custom_mesh_settings_2 = SettingsCustom(
    StitchSeams=True,
    SimplePlanes=False,
    Refine=True,
    MinCount=2,
    MaxCount=200,
    AspectRatio=20000,
    MaxDistance=0,
    MaxAngle=20000,
    MinEdge=10,
    MaxEdge=0)
boundary = BoundarySurfaces(Edges=c_script.curve)
mesh_2 = MeshBrep(Brep=boundary, Settings=custom_mesh_settings_2)
mjoin = MeshJoin(Meshes=mesh_2)
unim = UnifyMesh(Mesh=mjoin)  # -> Result, Count
scale = Scale(Geometry=unim.Result, Center=graft(pl_2), Factor=graft(remap_3.Clipped))  # -> Geometry, Transform
bbox = BoundingBox(Content=scale.Geometry, Plane=graft(pl_2))  # -> Box, Box_2
rotate = Rotate(Geometry=scale.Geometry, Angle=3.141592654, Plane=graft(pl_2))  # -> Geometry, Transform
debox = DeconstructBox(Box=simplify(bbox.Box))  # -> Plane, X, Y, Z
dedomain = DeconstructDomain(Domain=debox.Y)  # -> Start, End
abs_2 = Absolute(Value=dedomain.Start)
avr_3 = Average(Input=[abs_2, dedomain.End])
Z_2 = UnitZ(Factor=avr_3)

txt_4 = Text(txt_3)
vec_2 = Vector(Z_2)
mesh_3 = Mesh(rotate.Geometry)
shader_5 = Shader(p_n_c)
pt_9 = Point(solver.V)
pt_10 = Point(pt_6)
vec2pt_3 = Vector2Pt(PointA=pt_10, PointB=graft(pt_9), Unitize=False)  # -> Vector, Length
move_2 = Move(Geometry=mesh_3, Motion=vec2pt_3.Vector)  # -> Geometry, Transform
dprod_2 = DotProduct(VectorA=vec_2, VectorB=vec2pt_3.Vector, Unitize=False)
abs_3 = Absolute(Value=dprod_2)
division_2 = Division(A=dprod_2, B=abs_3)
multiplication_3 = Multiplication(A=vec_2, B=division_2)
move_3 = Move(Geometry=graft(pt_9), Motion=multiplication_3)  # -> Geometry, Transform
ln_4 = Line(StartPoint=move_3.Geometry, EndPoint=graft(pt_9))
ln_5 = Line(StartPoint=pt_10, EndPoint=graft(pt_9))
multiplication_4 = Multiplication(A=multiplication_3, B=2)
move_4 = Move(Geometry=move_2.Geometry, Motion=multiplication_4)  # -> Geometry, Transform
pipe_2 = Pipe(Curve=ln_5, Radius=3, Caps=0)
pipe_3 = Pipe(Curve=ln_4, Radius=3, Caps=0)
custom_mesh_settings_3 = SettingsCustom(
    StitchSeams=True,
    SimplePlanes=False,
    Refine=True,
    MinCount=4,
    MaxCount=400,
    AspectRatio=20000,
    MaxDistance=0,
    MaxAngle=200,
    MinEdge=8,
    MaxEdge=0)
mesh_4 = MeshBrep(Brep=pipe_3, Settings=custom_mesh_settings_3)
mesh_5 = MeshBrep(Brep=pipe_2, Settings=custom_mesh_settings_3)
preview_6 = CustomPreview(Geometry=flatten(move_4.Geometry), Material=shader_5)
preview_7 = CustomPreview(Geometry=flatten(mesh_4), Material=shader_5)
preview_8 = CustomPreview(Geometry=flatten(mesh_5), Material=shader_5)

pt_11 = Point(simplify(graft(solver.V)))  # disabled
pt_12 = Point(simplify(pt_6))  # disabled
dist = Distance(PointA=pt_12, PointB=pt_11)  # disabled
msphere_2 = MeshSphere(Base=pt_12, Radius=dist, UCount=5, VCount=5)  # disabled
cluster_17 = Cluster_2(mesh=msphere_2, pt_2=pt_11, A=number_slider, pt=pt_12)  # disabled
cluster_18 = Cluster_2(mesh=msphere_2, pt_2=cluster_17, A=number_slider, pt=pt_12)  # disabled
cluster_19 = Cluster_2(mesh=msphere_2, pt_2=cluster_18, A=number_slider, pt=pt_12)  # disabled
cluster_20 = Cluster_2(mesh=msphere_2, pt_2=cluster_19, A=number_slider, pt=pt_12)  # disabled

txt_5 = Text(graft(txt_4))
pt_13 = Point(move_3.Geometry)
devec = DeconstructVector(Vector=pt_13)  # -> XComponent, YComponent, ZComponent
join_4 = TextJoin(Text=[txt_5, devec.XComponent, devec.YComponent, devec.ZComponent], Join=",")  # -> flatten(Result)
panel_5 = Panel(join_4)

cluster_21 = Cluster_2(mesh=msphere_2, pt_2=cluster_20, A=number_slider, pt=pt_12)  # disabled
pt_14 = Point(cluster_21)  # disabled
ln_6 = Line(StartPoint=pt_12, EndPoint=pt_14)  # disabled

# ==== cluster Cluster
int = ClusterInput()
pp = ClusterInput()
int_2 = Integer(int)
join = TextJoin(Text=pp, Join=",")
item = ListItem(List=flatten(join), Index=int_2, Wrap=True)
split = TextSplit(Text=item, Separators=",")
path_mapper = PathMapper(split, source="{A;B}", target="{A}")
int_3 = Integer(path_mapper)
cset = CreateSet(List=int_3)  # -> Set, Map
sort = SortList(Keys=cset.Set)  # -> Keys, ValuesA
join_2 = TextJoin(Text=sort.Keys, Join=",")  # -> flatten(Result)
cset_2 = CreateSet(List=join_2)  # -> graft(Set), Map
split_2 = TextSplit(Text=cset_2.Set, Separators=",")  # -> simplify(Result)
R = ClusterOutput(split_2)

# ==== cluster Cluster_2
pt = ClusterInput()
pt_2 = ClusterInput()
pt_3 = Point(pt)
pt_4 = Point(pt_2)
mesh = ClusterInput()
pt_5 = Point(flatten([pt_4, pt_3]))
mesh_2 = Mesh(mesh)
cps = ClosestPoints(Point=pt_4, Cloud=pt_5, Count=5)  # -> ClosestPoint, CPIndex, Distance
dist = Distance(PointA=pt_4, PointB=cps.ClosestPoint)  # -> simplify(Distance)
larger = LargerThan(FirstNumber=dist, SecondNumber=2000)  # -> simplify(LargerThan), OrEqualTo
dispatch = Dispatch(List=cps.ClosestPoint, DispatchPattern=larger.LargerThan)  # -> ListA, ListB
avr = Average(Input=dispatch.ListB)
vec2pt = Vector2Pt(PointA=pt_4, PointB=avr, Unitize=False)  # -> Vector, Length
A = ClusterInput()
amp = Amplitude(Vector=vec2pt.Vector, Amplitude=A)  # -> simplify(Vector)
move = Move(Geometry=pt_4, Motion=amp)  # -> Geometry, Transform
meshcp = MeshClosestPoint(Point=move.Geometry, Mesh=mesh_2)  # -> Point, Index, Parameter
P = ClusterOutput(meshcp.Point)
