# Grasshopper definition test.gh (Grasshopper 1.0.7)

pt = Point(Point(0, 4, 0))
panel = Panel("""dio porco
dio""")
xy = XYPlane(Origin=pt)
xy_2 = XYPlane(Origin=Point(0, 0, 0))
c_script = CSharpScript(plane=[xy_2, xy], y=panel)  # -> out, simplify(curve), simplify(normal); inputs plane: Plane, y: String
# ---------- c_script: C# ----------
    var text_entity = new TextEntity
      {
        Plane = plane,
        RichText = y,
        Justification = TextJustification.MiddleCenter,
        FontIndex = doc.Fonts.FindOrCreate("Arial", false, false)
        };


    curve = text_entity.Explode();

    normal = plane.ZAxis;
# ---------- end c_script ----------
amp = Amplitude(Vector=c_script.normal, Amplitude=Slider(0.505, range=0..1))
boundary = BoundarySurfaces(Edges=c_script.curve)
extr = Extrude(Base=boundary, Direction=amp)
jagged = SettingsSpeed()
mesh = MeshBrep(Brep=extr, Settings=jagged)
mjoin = MeshJoin(Meshes=mesh)
unim = UnifyMesh(Mesh=mjoin)  # -> Result, Count
