# Grasshopper definition netreader_2.gh (Grasshopper 1.0.7)
# plug-ins: Sandbox Topology, Kangaroo2 Components

path = FilePath("C:\Users\rb1619\Documents\GitHub\scientific-data-visualization\Assets\Resources\Prefabs\3D\network\edges.csv")
path_2 = FilePath("C:\Users\rb1619\Documents\GitHub\scientific-data-visualization\Assets\Resources\Prefabs\3D\new_network\atlas_nodes.csv")
file = ReadFile(File=path_2, PerLineParse=True)
file_2 = ReadFile(File=path, PerLineParse=True)
split = TextSplit(Text=file, Separators=",")
split_2 = SplitList(List=file_2, Index=Slider(2742, range=0..2742))  # -> ListA, ListB
split_3 = TextSplit(Text=split_2.ListA, Separators=",")
item = ListItem(List=split, Index=1, Wrap=True)
item_2 = ListItem(List=split, Index=3, Wrap=True)
item_3 = ListItem(List=split, Index=4, Wrap=True)  # -> flatten(Item)
item_4 = ListItem(List=split, Index=5, Wrap=True)  # -> flatten(Item)
item_5 = ListItem(List=split, Index=6, Wrap=True)  # -> flatten(Item)
item_6 = ListItem(List=split_3, Index=0, Wrap=True)  # -> flatten(Item)
item_7 = ListItem(List=split_3, Index=1, Wrap=True)  # -> flatten(Item)
item_8 = ListItem(List=split_3, Index=2, Wrap=True)  # -> flatten(Item)
join = TextJoin(Text=[item, item_2], Join=" ")  # -> flatten(Result)
int = Integer(item_3)
int_2 = Integer(item_4)
int_3 = Integer(item_5)
int_4 = Integer(item_6)
int_5 = Integer(item_7)
int_6 = Integer(item_8)
pt = ConstructPoint(XCoordinate=int, YCoordinate=int_2, ZCoordinate=int_3)
item_9 = ListItem(List=pt, Index=int_5, Wrap=True)
item_10 = ListItem(List=pt, Index=int_4, Wrap=True)
ln = Line(StartPoint=item_10, EndPoint=item_9)
line_topo = LineTopology(ListOfLines=ln, Tolerance=0.001)  # -> ListOfPoints, LinePointStructure, PointPointStructure, PointLineStructure
fsim = FindSimilarMember(Data=pt, Set=line_topo.ListOfPoints)  # -> Hit, Index
fsim_2 = FindSimilarMember(Data=line_topo.ListOfPoints, Set=pt)  # -> Hit, Index
item_11 = ListItem(List=join, Index=fsim_2.Index, Wrap=True)
item_12 = ListItem(List=fsim.Index, Index=int_4, Wrap=True)
item_13 = ListItem(List=fsim.Index, Index=int_5, Wrap=True)
item_14 = ListItem(List=fsim.Index, Index=int_6, Wrap=True)
item_15 = ListItem(List=pt, Index=fsim_2.Index, Wrap=True)
txt = Text(item_11)
int_7 = Integer(item_12)
num = Number(item_14)
int_8 = Integer(item_13)
pt_2 = Point(item_15)
item_16 = ListItem(List=pt_2, Index=int_7, Wrap=True)
item_17 = ListItem(List=pt_2, Index=int_8, Wrap=True)
ln_2 = Line(StartPoint=item_16, EndPoint=item_17)

data = Data(line_topo.PointPointStructure)

viewer = ParamViewer(line_topo.PointPointStructure)
lng = ListLength(List=viewer)
series = Series(Start=0, Step=1, Count=lng)  # -> simplify(graft(Series))
merge = Merge(Data1=line_topo.PointPointStructure, Data2=series)
int_9 = Integer(merge)
cluster = Cluster(pp=int_9, int=int_9)
cluster_2 = Cluster(pp=int_9, int=cluster)
cluster_3 = Cluster(pp=int_9, int=cluster_2)
cluster_4 = Cluster(pp=int_9, int=cluster_3)
cluster_5 = Cluster(pp=int_9, int=cluster_4)
cluster_6 = Cluster(pp=int_9, int=cluster_5)
cluster_7 = Cluster(pp=int_9, int=cluster_6)
cluster_8 = Cluster(pp=int_9, int=cluster_7)
cluster_9 = Cluster(pp=int_9, int=cluster_8)
cluster_10 = Cluster(pp=int_9, int=cluster_9)
cluster_11 = Cluster(pp=int_9, int=cluster_10)
cluster_12 = Cluster(pp=int_9, int=cluster_11)
cluster_13 = Cluster(pp=int_9, int=cluster_12)
cluster_14 = Cluster(pp=int_9, int=cluster_13)
cluster_15 = Cluster(pp=int_9, int=cluster_14)
cluster_16 = Cluster(pp=int_9, int=cluster_15)
int_10 = Integer(cluster_16)
int_11 = Integer(int_7)
panel = Panel(cluster_16)
cset = CreateSet(List=cluster_16)  # -> Set, Map
mindex = MemberIndex(Set=int_11, Member=int_10)  # -> Index, Count
sort = SortList(Keys=cset.Set)  # -> Keys, ValuesA
join_2 = TextJoin(Text=cluster_16, Join=",")  # -> graft(Result)
path_mapper = PathMapper(mindex.Index, source="{A;B}", target="{A}")
join_3 = TextJoin(Text=cset.Set, Join=",")  # -> flatten(Result)
panel_2 = Panel(path_mapper)
cset_2 = CreateSet(List=join_3)  # -> Set, Map
split_4 = TextSplit(Text=cset_2.Set, Separators=",")  # -> simplify(Result)
int_12 = Integer(split_4)
lng_2 = ListLength(List=int_12)
smaller = SmallerThan(FirstNumber=lng_2, SecondNumber=10)  # -> flatten(SmallerThan), flatten(OrEqualTo)
dispatch = Dispatch(List=cset_2.Set, DispatchPattern=smaller.OrEqualTo)  # -> ListA, ListB
split_5 = TextSplit(Text=dispatch.ListA, Separators=",")  # -> simplify(flatten(Result))
split_6 = TextSplit(Text=dispatch.ListB, Separators=",")  # -> simplify(flatten(Result))
cset_3 = CreateSet(List=split_5)  # -> Set, Map
cset_4 = CreateSet(List=split_6)  # -> Set, Map
sort_2 = SortList(Keys=cset_3.Set)  # -> Keys, ValuesA
sort_3 = SortList(Keys=cset_4.Set)  # -> Keys, ValuesA
difference = SetDifference(SetA=sort_3.Keys, SetB=sort_2.Keys)
lng_3 = ListLength(List=cset_3.Set)
lng_4 = ListLength(List=difference)
addition = Addition(A=lng_3, B=lng_4)

pt_3 = Point(simplify(graft(line_topo.ListOfPoints)))
txt_2 = Text(txt)
int_13 = Integer(int_7)
num_2 = Number(num)
int_14 = Integer(int_8)
pt_4 = Point(pt_2)
data_2 = Data(data)
int_15 = Integer(difference)
int_16 = Integer(difference)
branch = TreeBranch(Tree=simplify(graft(txt_2)), Path=int_16, MaintainPaths=True)  # -> flatten(Branch)
branch_2 = TreeBranch(Tree=simplify(graft(pt_4)), Path=int_16, MaintainPaths=True)  # -> flatten(Branch)
intersection = SetIntersection(SetA=graft(int_13), SetB=int_15)
intersection_2 = SetIntersection(SetA=graft(int_14), SetB=int_15)
branch_3 = TreeBranch(Tree=pt_3, Path=int_16, MaintainPaths=True)  # -> flatten(Branch)
branch_4 = TreeBranch(Tree=data_2, Path=int_16, MaintainPaths=True)
lng_5 = ListLength(List=intersection)
lng_6 = ListLength(List=intersection_2)
multiplication = Multiplication(A=lng_5, B=lng_6)  # -> simplify(flatten(Result))
equals = Equality(FirstNumber=multiplication, SecondNumber=0)  # -> Equality, Inequality
dispatch_2 = Dispatch(List=int_13, DispatchPattern=equals.Equality)  # -> ListA, ListB
dispatch_3 = Dispatch(List=int_14, DispatchPattern=equals.Equality)  # -> ListA, ListB
dispatch_4 = Dispatch(List=num_2, DispatchPattern=equals.Equality)  # -> ListA, ListB
item_18 = ListItem(List=pt_4, Index=dispatch_2.ListB, Wrap=True)
item_19 = ListItem(List=pt_4, Index=dispatch_3.ListB, Wrap=True)
ln_3 = Line(StartPoint=item_18, EndPoint=item_19)

pt_5 = Point(branch_2)
pdecon = Deconstruct(Point=pt_5)  # -> XComponent, YComponent, ZComponent
bnd = Bounds(Numbers=pdecon.XComponent)
bnd_2 = Bounds(Numbers=pdecon.YComponent)
bnd_3 = Bounds(Numbers=pdecon.ZComponent)
dedomain = DeconstructDomain(Domain=bnd)  # -> Start, End
dedomain_2 = DeconstructDomain(Domain=bnd_2)  # -> Start, End
dedomain_3 = DeconstructDomain(Domain=bnd_3)  # -> Start, End
avr = Average(Input=[dedomain.End, dedomain.Start])
avr_2 = Average(Input=[dedomain_3.End, dedomain_3.Start])
avr_3 = Average(Input=[dedomain_2.End, dedomain_2.Start])
pt_6 = ConstructPoint(XCoordinate=avr, YCoordinate=avr_3, ZCoordinate=dedomain_3.Start)
pt_7 = ConstructPoint(XCoordinate=avr, YCoordinate=avr_3, ZCoordinate=dedomain_3.End)
pt_8 = ConstructPoint(XCoordinate=avr, YCoordinate=dedomain_2.Start, ZCoordinate=avr_2)
pt_9 = ConstructPoint(XCoordinate=avr, YCoordinate=dedomain_2.End, ZCoordinate=avr_2)
pt_10 = ConstructPoint(XCoordinate=dedomain.Start, YCoordinate=avr_3, ZCoordinate=avr_2)
pt_11 = ConstructPoint(XCoordinate=dedomain.End, YCoordinate=avr_3, ZCoordinate=avr_2)
int_17 = Integer(50)
ln_4 = Line(StartPoint=pt_6, EndPoint=pt_7)
ln_5 = Line(StartPoint=pt_8, EndPoint=pt_9)
ln_6 = Line(StartPoint=pt_10, EndPoint=pt_11)
pframes = PerpFrames(Curve=ln_4, Count=int_17, Align=True)  # -> graft(Frames), Parameters
pframes_2 = PerpFrames(Curve=ln_5, Count=int_17, Align=True)  # -> graft(Frames), Parameters
pframes_3 = PerpFrames(Curve=ln_6, Count=int_17, Align=True)  # -> graft(Frames), Parameters
num_3 = Number(7e-05)
metaball_t = MetaBallT(Points=pt_5, Plane=pframes.Frames, Threshold=num_3, Accuracy=10)  # -> simplify(Isocurve)
metaball_t_2 = MetaBallT(Points=pt_5, Plane=pframes_2.Frames, Threshold=num_3, Accuracy=10)  # -> simplify(Isocurve)
metaball_t_3 = MetaBallT(Points=pt_5, Plane=pframes_3.Frames, Threshold=num_3, Accuracy=10)  # -> simplify(Isocurve)
int_18 = Integer(80)
topoly = CurveToPolyline(Curve=metaball_t, ToleranceDistance=2, ToleranceAngle=0)  # -> Polyline, Segments
topoly_2 = CurveToPolyline(Curve=metaball_t_2, ToleranceDistance=2, ToleranceAngle=0)  # -> Polyline, Segments
topoly_3 = CurveToPolyline(Curve=metaball_t_3, ToleranceDistance=10, ToleranceAngle=0)  # -> Polyline, Segments
cp = ControlPoints(Curve=topoly.Polyline)  # -> flatten(Points), Weights, Knots
cp_2 = ControlPoints(Curve=topoly_2.Polyline)  # -> flatten(Points), Weights, Knots
cp_3 = ControlPoints(Curve=topoly_3.Polyline)  # -> flatten(Points), Weights, Knots
duppt = RemoveDuplicatePts(Points=cp.Points, Tolerance=int_18)
duppt_2 = RemoveDuplicatePts(Points=cp_2.Points, Tolerance=int_18)
duppt_3 = RemoveDuplicatePts(Points=cp_3.Points, Tolerance=int_18)
merge_2 = Merge(Data1=duppt, Data2=duppt_2, Data3=duppt_3)  # -> flatten(Result)

panel_3 = Panel(intersection_2)

pt_12 = Point(branch_2)

line = Line(ln_3)
int_19 = Integer(dispatch_4.ListB)
bnd_4 = Bounds(Numbers=int_19)
dom = ConstructDomain(DomainStart=5, DomainEnd=30)
dom_2 = ConstructDomain(DomainStart=0, DomainEnd=3)
remap = RemapNumbers(Value=int_19, Source=bnd_4, Target=dom)  # -> Mapped, Clipped
remap_2 = RemapNumbers(Value=int_19, Source=bnd_4, Target=dom_2)  # -> Mapped, Clipped
int_20 = Integer(remap_2.Mapped)
custom_mesh_settings = SettingsCustom(
    StitchSeams=True,
    SimplePlanes=False,
    Refine=True,
    MinCount=4,
    MaxCount=400,
    AspectRatio=20000,
    MaxDistance=0,
    MaxAngle=200,
    MinEdge=8,
    MaxEdge=0)
pipe = Pipe(Curve=line, Radius=remap.Mapped, Caps=0)  # -> flatten(Pipe)
equals_2 = Equality(FirstNumber=int_20, SecondNumber=0)  # -> Equality, Inequality
equals_3 = Equality(FirstNumber=int_20, SecondNumber=1)  # -> Equality, Inequality
equals_4 = Equality(FirstNumber=int_20, SecondNumber=2)  # -> Equality, Inequality
equals_5 = Equality(FirstNumber=int_20, SecondNumber=3)  # -> Equality, Inequality
mesh = MeshBrep(Brep=pipe, Settings=custom_mesh_settings)
dispatch_5 = Dispatch(List=mesh, DispatchPattern=equals_2.Equality)  # -> ListA, ListB
dispatch_6 = Dispatch(List=mesh, DispatchPattern=equals_5.Equality)  # -> ListA, ListB
dispatch_7 = Dispatch(List=mesh, DispatchPattern=equals_4.Equality)  # -> ListA, ListB
dispatch_8 = Dispatch(List=mesh, DispatchPattern=equals_3.Equality)  # -> ListA, ListB
preview = CustomPreview(
    Geometry=[dispatch_7.ListA, dispatch_6.ListA],
    Material={diffuse=RGB(51, 51, 51), emission=RGB(0, 0, 0), shine=0, specular=RGB(255, 255, 255), transparency=0})
preview_2 = CustomPreview(
    Geometry=dispatch_8.ListA,
    Material={diffuse=RGB(105, 105, 105), emission=RGB(0, 0, 0), shine=0, specular=RGB(255, 255, 255), transparency=0})
preview_3 = CustomPreview(
    Geometry=dispatch_5.ListA,
    Material={diffuse=RGB(45, 45, 45), emission=RGB(0, 0, 0), shine=0, specular=RGB(255, 255, 255), transparency=0})
preview_4 = CustomPreview(
    Geometry=mesh,
    Material={diffuse=RGB(45, 45, 45), emission=RGB(0, 0, 0), shine=0, specular=RGB(255, 255, 255), transparency=0})

cp_4 = ClosestPoint(Point=pt_12, Cloud=merge_2)  # -> ClosestPoint, CPIndex, Distance
ln_7 = Line(StartPoint=pt_12, EndPoint=cp_4.ClosestPoint)
pt_13 = Point(graft(pt_12))
vec2pt = Vector2Pt(PointA=pt_12, PointB=cp_4.ClosestPoint, Unitize=False)  # -> Vector, Length

pt_14 = Point(branch_3)
data_3 = Data(branch_4)
lng_7 = ListLength(List=data_3)  # -> flatten(Length)
bnd_5 = Bounds(Numbers=flatten(lng_7))
remap_3 = RemapNumbers(Value=lng_7, Source=bnd_5, Target=Domain(50, 80))  # -> Mapped, Clipped
remap_4 = RemapNumbers(Value=lng_7, Source=bnd_5, Target=Domain(30, 150))  # -> Mapped, Clipped
remap_5 = RemapNumbers(Value=lng_7, Source=bnd_5, Target=Domain(3, 6))  # -> Mapped, Clipped
remap_6 = RemapNumbers(Value=lng_7, Source=bnd_5, Target=Domain(0, 4))  # -> Mapped, Clipped
int_21 = Integer(remap_6.Mapped)
int_22 = Integer(remap_5.Clipped)
shader = Shader({diffuse=RGB(255, 0, 0), emission=RGB(0, 0, 0), shine=0, specular=RGB(255, 255, 255), transparency=0})
shader_2 = Shader({diffuse=RGB(255, 165, 0), emission=RGB(0, 0, 0), shine=0, specular=RGB(255, 255, 255), transparency=0})
shader_3 = Shader({diffuse=RGB(255, 245, 0), emission=RGB(0, 0, 0), shine=0, specular=RGB(255, 255, 255), transparency=0})
shader_4 = Shader({diffuse=RGB(137, 137, 137), emission=RGB(0, 0, 0), shine=0, specular=RGB(255, 255, 255), transparency=0})

remap_7 = RemapNumbers(Value=lng_7, Source=bnd_5, Target=Domain(0.1, 0.5))  # -> Mapped, Clipped
remap_8 = RemapNumbers(Value=lng_7, Source=bnd_5, Target=Domain(100, 500))  # -> Mapped, Clipped
multiplication_2 = Multiplication(A=vec2pt.Length, B=remap_7.Clipped)

txt_3 = Text(branch)
pt_15 = Point(branch_2)
X = UnitX(Factor=1)
Z = UnitZ(Factor=1)
X_2 = UnitX(Factor=1)
pl = PlaneNormal(Origin=pt_15, ZAxis=X)
pl_2 = ConstructPlane(Origin=pl, XAxis=X_2, YAxis=Z)
c_script = CSharpScript(plane=pl_2, text=txt_3)  # -> out, simplify(curve), simplify(normal); inputs plane: Plane, text: String
# ---------- c_script: C# ----------
    var text_entity = new TextEntity
      {
        Plane = plane,
        RichText = text,
        Justification = TextJustification.MiddleCenter,
        FontIndex = doc.Fonts.FindOrCreate("Arial", false, false)
        };


    curve = text_entity.Explode();

    normal = plane.ZAxis;
# ---------- end c_script ----------
custom_mesh_settings_2 = SettingsCustom(
    StitchSeams=True,
    SimplePlanes=False,
    Refine=True,
    MinCount=2,
    MaxCount=200,
    AspectRatio=20000,
    MaxDistance=0,
    MaxAngle=20000,
    MinEdge=10,
    MaxEdge=0)
boundary = BoundarySurfaces(Edges=c_script.curve)
mesh_2 = MeshBrep(Brep=boundary, Settings=custom_mesh_settings_2)
mjoin = MeshJoin(Meshes=mesh_2)
unim = UnifyMesh(Mesh=mjoin)  # -> Result, Count
scale = Scale(Geometry=unim.Result, Center=graft(pl_2), Factor=graft(remap_4.Clipped))  # -> Geometry, Transform
bbox = BoundingBox(Content=scale.Geometry, Plane=graft(pl_2))  # -> Box, Box_2
rotate = Rotate(Geometry=scale.Geometry, Angle=3.141592654, Plane=graft(pl_2))  # -> Geometry, Transform
debox = DeconstructBox(Box=simplify(bbox.Box))  # -> Plane, X, Y, Z
dedomain_4 = DeconstructDomain(Domain=debox.Y)  # -> Start, End
abs = Absolute(Value=dedomain_4.Start)
avr_4 = Average(Input=[abs, dedomain_4.End])
Z_2 = UnitZ(Factor=avr_4)

addition_2 = Addition(A=remap_8.Clipped, B=multiplication_2)
amp = Amplitude(Vector=vec2pt.Vector, Amplitude=addition_2)
msphereex = MeshSphereEx(Base=pt_14, Radius=remap_3.Mapped, Count=int_22)
move = Move(Geometry=pt_12, Motion=amp)  # -> Geometry, Transform

lng_8 = ListLength(List=msphereex)
lng_9 = ListLength(List=msphereex)
lng_10 = ListLength(List=msphereex)
lng_11 = ListLength(List=msphereex)
repeat = RepeatData(Data=shader, Length=lng_8)
repeat_2 = RepeatData(Data=shader_4, Length=lng_9)
repeat_3 = RepeatData(Data=shader_3, Length=lng_10)
repeat_4 = RepeatData(Data=shader_2, Length=lng_11)
p_n_c = PickNChoose(Pattern=int_21, Stream0=repeat_2, Stream1=repeat_3, Stream2=repeat_4, Stream3=repeat_4, Stream4=repeat)
preview_5 = CustomPreview(Geometry=msphereex, Material=p_n_c)

pt_16 = Point(move.Geometry)
pt_17 = Point(pt_13)
num_4 = Number(800)
number_slider = Slider(1.03, range=1..1.1)
cluster_17 = Cluster_2(F=number_slider, pt=pt_17, in=pt_16, B=num_4)  # -> P, V, in_3
vdis = VectorDisplay(Anchor=cluster_17.in_3, Vector=cluster_17.V)
cluster_18 = Cluster_2(F=number_slider, pt=pt_17, in=cluster_17.P, B=num_4)  # -> P, V, in_3
vdis_2 = VectorDisplay(Anchor=cluster_18.in_3, Vector=cluster_18.V)
cluster_19 = Cluster_2(F=number_slider, pt=pt_17, in=cluster_18.P, B=num_4)  # -> P, V, in_3
vdis_3 = VectorDisplay(Anchor=cluster_19.in_3, Vector=cluster_19.V)
cluster_20 = Cluster_2(F=number_slider, pt=pt_17, in=cluster_19.P, B=num_4)  # -> P, V, in_3
vdis_4 = VectorDisplay(Anchor=cluster_20.in_3, Vector=cluster_20.V)
cluster_21 = Cluster_2(F=number_slider, pt=pt_17, in=cluster_20.P, B=num_4)  # -> P, V, in_3
vdis_5 = VectorDisplay(Anchor=cluster_21.in_3, Vector=cluster_21.V)
cluster_22 = Cluster_2(F=number_slider, pt=pt_17, in=cluster_21.P, B=num_4)  # -> P, V, in_3
vdis_6 = VectorDisplay(Anchor=cluster_22.in_3, Vector=cluster_22.V)
cluster_23 = Cluster_2(F=number_slider, pt=pt_17, in=cluster_22.P, B=num_4)  # -> P, V, in_3
vdis_7 = VectorDisplay(Anchor=cluster_23.in_3, Vector=cluster_23.V)
cluster_24 = Cluster_2(F=number_slider, pt=pt_17, in=cluster_23.P, B=num_4)  # -> P, V, in_3
vdis_8 = VectorDisplay(Anchor=cluster_24.in_3, Vector=cluster_24.V)
cluster_25 = Cluster_2(F=number_slider, pt=pt_17, in=cluster_24.P, B=num_4)  # -> P, V, in_3
vdis_9 = VectorDisplay(Anchor=cluster_25.in_3, Vector=cluster_25.V)
cluster_26 = Cluster_2(F=number_slider, pt=pt_17, in=cluster_25.P, B=num_4)  # -> P, V, in_3
vdis_10 = VectorDisplay(Anchor=cluster_26.in_3, Vector=cluster_26.V)
cluster_27 = Cluster_2(F=number_slider, pt=pt_17, in=cluster_26.P, B=num_4)  # -> P, V, in_3
vdis_11 = VectorDisplay(Anchor=cluster_27.in_3, Vector=cluster_27.V)
cluster_28 = Cluster_2(F=number_slider, pt=pt_17, in=cluster_27.P, B=num_4)  # -> P, V, in_3
vdis_12 = VectorDisplay(Anchor=cluster_28.in_3, Vector=cluster_28.V)
cluster_29 = Cluster_2(F=number_slider, pt=pt_17, in=cluster_28.P, B=num_4)  # -> P, V, in_3
vdis_13 = VectorDisplay(Anchor=cluster_29.in_3, Vector=cluster_29.V)
cluster_30 = Cluster_2(F=number_slider, pt=pt_17, in=cluster_29.P, B=num_4)  # -> P, V, in_3
vdis_14 = VectorDisplay(Anchor=cluster_30.in_3, Vector=cluster_30.V)
cluster_31 = Cluster_2(F=number_slider, pt=pt_17, in=cluster_30.P, B=num_4)  # -> P, V, in_3
vdis_15 = VectorDisplay(Anchor=cluster_31.in_3, Vector=cluster_31.V)
cluster_32 = Cluster_2(F=number_slider, pt=pt_17, in=cluster_31.P, B=num_4)  # -> P, V, in_3
cluster_33 = Cluster_2(F=number_slider, pt=cluster_32.P, in=pt_16, B=num_4)  # -> P, V, in_3
vdis_16 = VectorDisplay(Anchor=cluster_33.in_3, Vector=cluster_33.V)
cluster_34 = Cluster_2(F=number_slider, pt=pt_17, in=cluster_33.P, B=num_4)  # -> P, V, in_3
vdis_17 = VectorDisplay(Anchor=cluster_34.in_3, Vector=cluster_34.V)
cluster_35 = Cluster_2(F=number_slider, pt=pt_17, in=cluster_34.P, B=num_4)  # -> P, V, in_3
vdis_18 = VectorDisplay(Anchor=cluster_35.in_3, Vector=cluster_35.V)
cluster_36 = Cluster_2(F=number_slider, pt=pt_17, in=cluster_35.P, B=num_4)  # -> P, V, in_3
vdis_19 = VectorDisplay(Anchor=cluster_36.in_3, Vector=cluster_36.V)
cluster_37 = Cluster_2(F=number_slider, pt=pt_17, in=cluster_36.P, B=num_4)  # -> P, V, in_3
vdis_20 = VectorDisplay(Anchor=cluster_37.in_3, Vector=cluster_37.V)
cluster_38 = Cluster_2(F=number_slider, pt=pt_17, in=cluster_37.P, B=num_4)  # -> P, V, in_3
vdis_21 = VectorDisplay(Anchor=cluster_38.in_3, Vector=cluster_38.V)
cluster_39 = Cluster_2(F=number_slider, pt=pt_17, in=cluster_38.P, B=num_4)  # -> P, V, in_3
vdis_22 = VectorDisplay(Anchor=cluster_39.in_3, Vector=cluster_39.V)
cluster_40 = Cluster_2(F=number_slider, pt=pt_17, in=cluster_39.P, B=num_4)  # -> P, V, in_3
vdis_23 = VectorDisplay(Anchor=cluster_40.in_3, Vector=cluster_40.V)
cluster_41 = Cluster_2(F=number_slider, pt=pt_17, in=cluster_40.P, B=num_4)  # -> P, V, in_3
vdis_24 = VectorDisplay(Anchor=cluster_41.in_3, Vector=cluster_41.V)
cluster_42 = Cluster_2(F=number_slider, pt=pt_17, in=cluster_41.P, B=num_4)  # -> P, V, in_3
vdis_25 = VectorDisplay(Anchor=cluster_42.in_3, Vector=cluster_42.V)
cluster_43 = Cluster_2(F=number_slider, pt=pt_17, in=cluster_42.P, B=num_4)  # -> P, V, in_3
vdis_26 = VectorDisplay(Anchor=cluster_43.in_3, Vector=cluster_43.V)
cluster_44 = Cluster_2(F=number_slider, pt=pt_17, in=cluster_43.P, B=num_4)  # -> P, V, in_3
vdis_27 = VectorDisplay(Anchor=cluster_44.in_3, Vector=cluster_44.V)
cluster_45 = Cluster_2(F=number_slider, pt=pt_17, in=cluster_44.P, B=num_4)  # -> P, V, in_3
vdis_28 = VectorDisplay(Anchor=cluster_45.in_3, Vector=cluster_45.V)
cluster_46 = Cluster_2(F=number_slider, pt=pt_17, in=cluster_45.P, B=num_4)  # -> P, V, in_3
vdis_29 = VectorDisplay(Anchor=cluster_46.in_3, Vector=cluster_46.V)
cluster_47 = Cluster_2(F=number_slider, pt=pt_17, in=cluster_46.P, B=num_4)  # -> P, V, in_3
vdis_30 = VectorDisplay(Anchor=cluster_47.in_3, Vector=cluster_47.V)
cluster_48 = Cluster_2(F=number_slider, pt=pt_17, in=cluster_47.P, B=num_4)  # -> P, V, in_3
vdis_31 = VectorDisplay(Anchor=cluster_48.in_3, Vector=cluster_48.V)
vdis_32 = VectorDisplay(Anchor=cluster_32.in_3, Vector=cluster_32.V)

txt_4 = Text(txt_3)
vec = Vector(Z_2)
mesh_3 = Mesh(rotate.Geometry)
shader_5 = Shader(p_n_c)
pt_18 = Point(cluster_48.P)
pt_19 = Point(pt_13)
vec2pt_2 = Vector2Pt(PointA=pt_19, PointB=graft(pt_18), Unitize=False)  # -> Vector, Length
move_2 = Move(Geometry=mesh_3, Motion=vec2pt_2.Vector)  # -> Geometry, Transform
dprod = DotProduct(VectorA=vec, VectorB=vec2pt_2.Vector, Unitize=False)
abs_2 = Absolute(Value=dprod)
division = Division(A=dprod, B=abs_2)
multiplication_3 = Multiplication(A=vec, B=division)
move_3 = Move(Geometry=graft(pt_18), Motion=multiplication_3)  # -> Geometry, Transform
ln_8 = Line(StartPoint=move_3.Geometry, EndPoint=graft(pt_18))
ln_9 = Line(StartPoint=pt_19, EndPoint=graft(pt_18))
multiplication_4 = Multiplication(A=multiplication_3, B=2)
move_4 = Move(Geometry=move_2.Geometry, Motion=multiplication_4)  # -> Geometry, Transform
pipe_2 = Pipe(Curve=ln_9, Radius=3, Caps=0)
pipe_3 = Pipe(Curve=ln_8, Radius=3, Caps=0)
custom_mesh_settings_3 = SettingsCustom(
    StitchSeams=True,
    SimplePlanes=False,
    Refine=True,
    MinCount=4,
    MaxCount=400,
    AspectRatio=20000,
    MaxDistance=0,
    MaxAngle=200,
    MinEdge=8,
    MaxEdge=0)
mesh_4 = MeshBrep(Brep=pipe_3, Settings=custom_mesh_settings_3)
mesh_5 = MeshBrep(Brep=pipe_2, Settings=custom_mesh_settings_3)
preview_6 = CustomPreview(Geometry=flatten(move_4.Geometry), Material=shader_5)
preview_7 = CustomPreview(Geometry=flatten(mesh_4), Material=shader_5)
preview_8 = CustomPreview(Geometry=flatten(mesh_5), Material=shader_5)

txt_5 = Text(graft(txt_4))
pt_20 = Point(move_3.Geometry)
devec = DeconstructVector(Vector=pt_20)  # -> XComponent, YComponent, ZComponent
join_4 = TextJoin(Text=[txt_5, devec.XComponent, devec.YComponent, devec.ZComponent], Join=",")  # -> flatten(Result)
panel_4 = Panel(join_4)

# ==== cluster Cluster
int = ClusterInput()
pp = ClusterInput()
int_2 = Integer(int)
join = TextJoin(Text=pp, Join=",")
item = ListItem(List=flatten(join), Index=int_2, Wrap=True)
split = TextSplit(Text=item, Separators=",")
path_mapper = PathMapper(split, source="{A;B}", target="{A}")
int_3 = Integer(path_mapper)
cset = CreateSet(List=int_3)  # -> Set, Map
sort = SortList(Keys=cset.Set)  # -> Keys, ValuesA
join_2 = TextJoin(Text=sort.Keys, Join=",")  # -> flatten(Result)
cset_2 = CreateSet(List=join_2)  # -> graft(Set), Map
split_2 = TextSplit(Text=cset_2.Set, Separators=",")  # -> simplify(Result)
R = ClusterOutput(split_2)

# ==== cluster Cluster_2
pt = ClusterInput()
in = ClusterInput()
pt_2 = Point(simplify(flatten(pt)))
in_2 = Point(simplify(graft(in)))
in_3 = ClusterOutput(in_2)
pt_3 = Point(flatten([in_2, pt_2]))
panel = Panel(pt_2)
cps = ClosestPoints(Point=in_2, Cloud=pt_3, Count=5)  # -> ClosestPoint, CPIndex, Distance
split = SplitList(List=cps.ClosestPoint, Index=1)  # -> ListA, simplify(ListB)
dist = Distance(PointA=in_2, PointB=split.ListB)
B = ClusterInput()
dist_2 = Distance(PointA=pt_2, PointB=flatten(in_2))
smaller = SmallerThan(FirstNumber=dist, SecondNumber=B)  # -> simplify(SmallerThan), OrEqualTo
dispatch = Dispatch(List=split.ListB, DispatchPattern=smaller.SmallerThan)  # -> ListA, ListB
X = UnitX(Factor=1)
vec2pt = Vector2Pt(PointA=in_2, PointB=dispatch.ListA, Unitize=False)  # -> Vector, Length
lng = ListLength(List=vec2pt.Vector)
equals = Equality(FirstNumber=lng, SecondNumber=0)  # -> Equality, Inequality
p_n_c = PickNChoose(Pattern=equals.Equality, Stream1=X)
bnd = Bounds(Numbers=vec2pt.Length)
unit = UnitVector(Vector=vec2pt.Vector)
clean = CleanTree(RemoveNulls=True, RemoveInvalid=True, RemoveEmpty=False, Tree=p_n_c)
rev = Reverse(Vector=unit)
remap = RemapNumbers(Value=vec2pt.Length, Source=bnd, Target=Domain(100, 20))  # -> Mapped, Clipped
merge = Merge(Data1=clean, Data2=rev)
null = NullItem(Item=remap.Clipped)  # -> NullFlags, InvalidFlags, Description
p_n_c_2 = PickNChoose(Pattern=null.NullFlags, Stream0=remap.Clipped, Stream1=1e-07)
amp = Amplitude(Vector=merge, Amplitude=p_n_c_2)
avr = Average(Input=amp)
msphereex = MeshSphereEx(Base=pt_2, Radius=dist_2, Count=4)  # -> graft(Mesh)
F = ClusterInput()
move = Move(Geometry=in_2, Motion=avr)  # -> Geometry, Transform
scale = Scale(Geometry=flatten(msphereex), Center=pt_2, Factor=F)  # -> graft(Geometry), Transform
meshcp = MeshClosestPoint(Point=move.Geometry, Mesh=scale.Geometry)  # -> Point, Index, Parameter
P = ClusterOutput(meshcp.Point)
vec2pt_2 = Vector2Pt(PointA=in_2, PointB=meshcp.Point, Unitize=False)  # -> Vector, Length
V = ClusterOutput(vec2pt_2.Vector)
