# Grasshopper definition puzle.gh (Grasshopper 1.0.7)
# plug-ins: Weaverbird

mesh = Mesh([<mesh referenced from the Rhino model> x6])
int = Integer(5)
int_2 = Integer(3)
area = Area(Geometry=mesh)  # -> Area, graft(Centroid)
addition = Addition(A=int_2, B=1)
facen = FaceNormals(Mesh=mesh)  # -> Centers, Normals
lng = ListLength(List=flatten(area.Centroid))
int_3 = Integer(1)
multiplication = Multiplication(A=int, B=int_2)
int_4 = Integer(0)
multiplication_2 = Multiplication(A=int, B=addition)
avr = Average(Input=facen.Normals)
multiplication_3 = Multiplication(A=lng, B=5)
bnd = Bounds(Numbers=[multiplication, int_4])
rev = Reverse(Vector=avr)
Z = UnitZ(Factor=1)
sqgrid = Square(Plane=PlaneXY(0, 0, 0), Size=multiplication_2, ExtentX=int_3, ExtentY=int_3)  # -> Cells, simplify(flatten(Points))
sqgrid_2 = Square(Plane=sqgrid.Points, Size=int, ExtentX=int_2, ExtentY=int_2)  # -> simplify(Cells), Points
number_slider = Slider(5, range=0..10)
random = Random(Range=Domain(0, 6), Number=multiplication_3, Seed=number_slider)
int_5 = Integer(random)
xprod = CrossProduct(VectorA=rev, VectorB=Z, Unitize=False)  # -> Vector, Length
offset = OffsetCurve(Curve=sqgrid_2.Cells, Distance=-0.01, Plane=PlaneXY(0, 0, 0), Corners=1)
lng_2 = ListLength(List=sqgrid.Points)
txt = Text(int_5)
path_mapper = PathMapper(offset, source="{A;B;C}", target="{A}")
path_mapper_2 = PathMapper(offset, source="{A;B;C}", target="{A;B}")
path_mapper_3 = PathMapper(path_mapper_2, source="{A;B}", target="{A}")
pl = ConstructPlane(Origin=area.Centroid, XAxis=xprod.Vector, YAxis=Z)
subtraction = Subtraction(A=lng_2, B=1)
rectangle = Rectangle(Plane=sqgrid.Points, XSize=bnd, YSize=bnd, Radius=0)  # -> graft(Rectangle), Length
pl_2 = ConstructPlane(Origin=Point(0, 0, 0), XAxis=Vector(1, 0, 0), YAxis=Vector(0, 1, 0))
int_6 = Integer(-5)
cset = CreateSet(List=txt)  # -> Set, Map
series = Series(Start=number_slider, Step=subtraction, Count=lng_2)  # -> simplify(graft(Series))
Z_2 = UnitZ(Factor=int_6)
lng_3 = ListLength(List=path_mapper_3)
shift = ShiftList(List=flatten(series), Shift=-1, Wrap=True)  # -> graft(List)
split = SplitList(List=cset.Set, Index=lng)  # -> graft(ListA), ListB
c_script = CSharpScript(plane=pl_2, text=split.ListA)  # -> out, simplify(curve), simplify(normal); inputs plane: Plane, text: String
# ---------- c_script: C# ----------
    var text_entity = new TextEntity
      {
        Plane = plane,
        RichText = text,
        Justification = TextJustification.MiddleCenter,
        FontIndex = doc.Fonts.FindOrCreate("Arial", false, false)
        };


    curve = text_entity.Explode();

    normal = plane.ZAxis;
# ---------- end c_script ----------
crv = Curve(simplify(graft(path_mapper_3)))
dom = ConstructDomain(DomainStart=0, DomainEnd=2)
move = Move(Geometry=rectangle.Rectangle, Motion=Z_2)  # -> Geometry, Transform
orient = Orient(Geometry=c_script.curve, Source=pl_2, Target=pl)  # -> Geometry, Transform
panel = Panel(shift)
panel_2 = Panel(crv)
viewer = ParamViewer(series)
random_2 = Random(Range=dom, Number=lng_3, Seed=series)  # -> simplify(Random)
boundary = BoundarySurfaces(Edges=flatten([path_mapper, rectangle.Rectangle]))  # -> simplify(graft(Surfaces))
Z_3 = UnitZ(Factor=5)
scale = Scale(Geometry=orient.Geometry, Center=area.Centroid, Factor=5)  # -> Geometry, Transform
loft = Loft(
    Curves=simplify([rectangle.Rectangle, move.Geometry]),
    Options={Adjust=False, Closed=False, LoftEnds=0, LoftSimp=0, LoftType=0, Rebuild=10, Refit=0.01})
branch = TreeBranch(Tree=simplify(move.Geometry), Path="{0}", MaintainPaths=True)
random_3 = Random(Range=dom, Number=lng_3, Seed=shift)  # -> simplify(Random)
int_7 = Integer(random_3)
boundary_2 = BoundarySurfaces(Edges=branch)
int_8 = Integer(random_2)
rev_2 = Reverse(Vector=Z_3)
boundary_3 = BoundarySurfaces(Edges=scale.Geometry)
multiplication_4 = Multiplication(A=int_7, B=2)
split_2 = SplitList(List=viewer, Index=1)  # -> ListA, ListB
multiplication_5 = Multiplication(A=int_8, B=2)
panel_3 = Panel(boundary_2)
branch_2 = TreeBranch(Tree=multiplication_4, Path=split_2.ListB, MaintainPaths=True)
bnd_2 = Bounds(Numbers=branch_2)
dedomain = DeconstructDomain(Domain=bnd_2)  # -> Start, End
dom_2 = ConstructDomain(DomainStart=dedomain.End, DomainEnd=dedomain.Start)
mesh_2 = MeshBrep(
    Brep=boundary_3,
    Settings={GridMaxCount=0, GridMinCount=16, JaggedSeams=False, MaxEdgeLength=0, MinEdgeLength=0.0001, MinTolerance=0, Refine=True, RefineAngle=0, RelativeTolerance=0.65, SimplePlanes=True, Tolerance=0})
branch_3 = TreeBranch(Tree=path_mapper_3, Path=split_2.ListB, MaintainPaths=True)
remap = RemapNumbers(Value=branch_2, Source=bnd_2, Target=dom_2)  # -> Mapped, Clipped
Z_4 = UnitZ(Factor=multiplication_5)
vlen = VectorLength(Vector=Z_4)
Z_5 = UnitZ(Factor=remap.Mapped)
move_2 = Move(Geometry=simplify(boundary), Motion=simplify(rev_2))  # -> simplify(Geometry), Transform
Z_6 = UnitZ(Factor=5)
Z_7 = UnitZ(Factor=5)
subtraction_2 = Subtraction(A=vlen, B=0.25)
rev_3 = Reverse(Vector=Z_5)
vlen_2 = VectorLength(Vector=rev_3)
rev_4 = Reverse(Vector=Z_7)
Z_8 = UnitZ(Factor=5)
amp = Amplitude(Vector=Z_4, Amplitude=subtraction_2)
rev_5 = Reverse(Vector=Z_6)
subtraction_3 = Subtraction(A=vlen_2, B=0.25)
move_3 = Move(Geometry=simplify(branch_3), Motion=simplify(rev_3))  # -> Geometry, Transform
move_4 = Move(Geometry=simplify(path_mapper_3), Motion=simplify(Z_4))  # -> simplify(graft(Geometry)), Transform
rev_6 = Reverse(Vector=Z_8)
move_5 = Move(Geometry=simplify(path_mapper_3), Motion=simplify(amp))  # -> simplify(graft(Geometry)), Transform
amp_2 = Amplitude(Vector=rev_3, Amplitude=subtraction_3)
move_6 = Move(Geometry=simplify(branch_3), Motion=simplify(amp_2))  # -> Geometry, Transform
move_7 = Move(Geometry=simplify(branch_3), Motion=simplify(rev_4))  # -> simplify(graft(Geometry)), Transform
move_8 = Move(Geometry=simplify(move_3.Geometry), Motion=simplify(rev_5))  # -> simplify(graft(Geometry)), Transform
move_9 = Move(Geometry=simplify(move_6.Geometry), Motion=simplify(rev_6))  # -> simplify(graft(Geometry)), Transform
offset_2 = OffsetCurve(Curve=move_4.Geometry, Distance=-0.25, Plane=PlaneXY(0, 0, 0), Corners=1)  # -> simplify(Curve)
offset_3 = OffsetCurve(Curve=move_8.Geometry, Distance=-0.25, Plane=PlaneXY(0, 0, 0), Corners=1)  # -> simplify(Curve)
loft_2 = Loft(
    Curves=simplify([move_9.Geometry, move_7.Geometry]),
    Options={Adjust=False, Closed=False, LoftEnds=0, LoftSimp=0, LoftType=0, Rebuild=10, Refit=0.01})
boundary_4 = BoundarySurfaces(Edges=offset_2)
loft_3 = Loft(
    Curves=simplify([move_5.Geometry, offset_2]),
    Options={Adjust=False, Closed=False, LoftEnds=0, LoftSimp=0, LoftType=0, Rebuild=10, Refit=0.01})  # -> simplify(Loft)
loft_4 = Loft(
    Curves=simplify([move_8.Geometry, move_7.Geometry]),
    Options={Adjust=False, Closed=False, LoftEnds=0, LoftSimp=0, LoftType=0, Rebuild=10, Refit=0.01})
loft_5 = Loft(
    Curves=simplify([move_5.Geometry, crv]),
    Options={Adjust=False, Closed=False, LoftEnds=0, LoftSimp=0, LoftType=0, Rebuild=10, Refit=0.01})  # -> simplify(Loft)
loft_6 = Loft(
    Curves=simplify([offset_3, move_9.Geometry]),
    Options={Adjust=False, Closed=False, LoftEnds=0, LoftSimp=0, LoftType=0, Rebuild=10, Refit=0.01})
boundary_5 = BoundarySurfaces(Edges=offset_3)
path_mapper_4 = PathMapper(loft_6, source="{A;B}", target="{A}")
path_mapper_5 = PathMapper(boundary_5, source="{A;B}", target="{A}")
path_mapper_6 = PathMapper(loft_2, source="{A;B}", target="{A}")
path_mapper_7 = PathMapper(boundary_4, source="{A;B}", target="{A}")
path_mapper_8 = PathMapper(loft_3, source="{A;B}", target="{A}")
path_mapper_9 = PathMapper(loft_5, source="{A;B}", target="{A}")
join = BrepJoin(Breps=[path_mapper_5, path_mapper_6, path_mapper_7, path_mapper_8, loft, boundary, move_2.Geometry, boundary_2, path_mapper_4, path_mapper_9])  # -> Breps, Closed
shader = Shader({diffuse=RGB(255, 248, 0), emission=RGB(0, 0, 0), shine=0, specular=RGB(255, 255, 255), transparency=0})
custom_mesh_settings = SettingsCustom(
    StitchSeams=True,
    SimplePlanes=False,
    Refine=True,
    MinCount=1,
    MaxCount=400,
    AspectRatio=200000,
    MaxDistance=0,
    MaxAngle=20,
    MinEdge=0,
    MaxEdge=0)
shader_2 = Shader({diffuse=RGB(51, 255, 0), emission=RGB(0, 0, 0), shine=0, specular=RGB(255, 255, 255), transparency=0})
shader_3 = Shader({diffuse=RGB(255, 0, 0), emission=RGB(0, 0, 0), shine=0, specular=RGB(255, 255, 255), transparency=0})
shader_4 = Shader({diffuse=RGB(0, 2, 255), emission=RGB(0, 0, 0), shine=0, specular=RGB(255, 255, 255), transparency=0})
shader_5 = Shader(simplify(graft([shader_2, shader, shader_3, shader_4])))
viewer_2 = ParamViewer(shader_5)
lng_4 = ListLength(List=flatten(shader_5))
mesh_3 = MeshBrep(Brep=join.Breps, Settings=custom_mesh_settings)
pcen = PolygonCenter(Polyline=rectangle.Rectangle)  # -> simplify(CenterV), CenterE, CenterA
mjoin = MeshJoin(Meshes=mesh_3)
multiplication_6 = Multiplication(A=lng_4, B=5)
wbtriangles = WeaverbirdsSplitTrianglesSubdivision(MeshCurves=mjoin, Level=10)  # -> simplify(OutputMeshCurves)
dpath = DeconstructPath(Branch=viewer_2)  # -> flatten(Indices)
unim = UnifyMesh(Mesh=wbtriangles)  # -> Result, Count
bnd_3 = Bounds(Numbers=dpath)
random_4 = Random(Range=bnd_3, Number=multiplication_6, Seed=number_slider)
int_9 = Integer(random_4)
panel_4 = Panel(unim.Result)
txt_2 = Text(int_9)
branch_4 = TreeBranch(Tree=pcen.CenterV, Path="{0}", MaintainPaths=True)  # -> graft(Branch)
branch_5 = TreeBranch(Tree=unim.Result, Path=split_2.ListB, MaintainPaths=True)
branch_6 = TreeBranch(Tree=pcen.CenterV, Path=split_2.ListB, MaintainPaths=True)
series_2 = Series(Start=0, Step=Slider(10.053, range=0..20), Count=lng_2)
branch_7 = TreeBranch(Tree=unim.Result, Path="{0}", MaintainPaths=True)
cset_2 = CreateSet(List=txt_2)  # -> Set, Map
Z_9 = UnitZ(Factor=series_2)
demesh = DeconstructMesh(Mesh=branch_7)  # -> Vertices, Faces, Colours, Normals
txt_3 = Text("0")
split_3 = SplitList(List=cset_2.Set, Index=lng_4)  # -> simplify(ListA), ListB
item = ListItem(List=flatten(shader_5), Index=split_3.ListA, Wrap=True)  # -> simplify(graft(Item))
branch_8 = TreeBranch(Tree=item, Path=split_2.ListB, MaintainPaths=True)
move_10 = Move(Geometry=branch_4, Motion=Z_9)  # -> simplify(graft(Geometry)), Transform
avr_2 = Average(Input=demesh.Vertices)
difference = SetDifference(SetA=split_3.ListA, SetB=txt_3)
lng_5 = ListLength(List=flatten(branch_5))
subtraction_4 = Subtraction(A=difference, B=2)
circle = CircleCNR(Center=avr_2, Normal=Vector(0, 0, 1), Radius=Slider(32.125, range=0..100))
branch_9 = TreeBranch(Tree=move_10.Geometry, Path=split_2.ListB, MaintainPaths=True)
panel_5 = Panel(branch_9)
panel_6 = Panel(difference)
pframes = PerpFrames(Curve=circle, Count=lng_5, Align=False)  # -> simplify(Frames), Parameters
item_2 = ListItem(List=pframes.Frames, Index=difference, Wrap=True)  # -> simplify(graft(Item))
orient_2 = Orient(Geometry=branch_5, Source=branch_6, Target=item_2)  # -> Geometry, Transform
orient_3 = Orient(Geometry=branch_5, Source=branch_6, Target=branch_9)  # -> Geometry, Transform
merge = Merge(Data1=orient_2.Geometry, Data2=branch_7)  # -> simplify(Result)
preview = CustomPreview(Geometry=orient_3.Geometry, Material=branch_8)
preview_2 = CustomPreview(Geometry=merge, Material=item)
preview_3 = CustomPreview(
    Geometry=mesh_2,
    Material={diffuse=RGB(0, 0, 0), emission=RGB(0, 0, 0), shine=0, specular=RGB(255, 255, 255), transparency=0})
